# Grasshopper definition TASS_4.gh (Grasshopper 1.0.8)
# plug-ins: RhinoCodePluginGH, MeshEdit Components, Human, Weaverbird, Kangaroo2 Components, NGon_RH8

# ---- group: Ellissi_Oculi
a_x = Slider(35, range=-180..180)
a_y = Slider(0, range=-180..180)
a_z = Slider(0, range=-180..180)
h_1 = Slider(0, range=-1.5..3)
pt = Point(<point referenced from the Rhino model>)
c_script = CSharpScript(pt=pt, rx=a_x, ry=a_y, rz=a_z, zOffset=h_1)  # -> out, a; inputs pt: Point3d, zOffset: Double
# ---------- c_script: C# ----------
// Grasshopper Script Instance
#region Usings
using System;
using System.Linq;
using System.Collections;
using System.Collections.Generic;
using System.Drawing;

using Rhino;
using Rhino.Geometry;

using Grasshopper;
using Grasshopper.Kernel;
using Grasshopper.Kernel.Data;
using Grasshopper.Kernel.Types;
#endregion

public class Script_Instance : GH_ScriptInstance
{
    #region Notes
    /* 
      Members:
        RhinoDoc RhinoDocument
        GH_Document GrasshopperDocument
        IGH_Component Component
        int Iteration

      Methods (Virtual & overridable):
        Print(string text)
        Print(string format, params object[] args)
        Reflect(object obj)
        Reflect(object obj, string method_name)
    */
    #endregion

  private static Plane storedPlane = Plane.Unset;
private static double lastRx = 0;
private static double lastRy = 0;
private static double lastRz = 0;
private static Point3d lastPt = Point3d.Unset;
  private void RunScript(
	Point3d pt,
	object rx,
	object ry,
	object rz,
	double zOffset,
	ref object a)
    {
// Cast degli input
double rxVal = (double) rx;
double ryVal = (double) ry;
double rzVal = (double) rz;

// Inizializza o aggiorna il piano se il punto è cambiato
if (!storedPlane.IsValid || pt.DistanceTo(lastPt) > 1e-6)
{
  storedPlane = new Plane(pt, Vector3d.XAxis, Vector3d.YAxis);
  lastRx = rxVal;
  lastRy = ryVal;
  lastRz = rzVal;
  lastPt = pt;
}


if (rxVal == 0 && ryVal == 0 && rzVal == 0)
{
  storedPlane = new Plane(pt, Vector3d.XAxis, Vector3d.YAxis);
  lastRx = 0;
  lastRy = 0;
  lastRz = 0;
  lastPt = pt;
}

double deltaRx = RhinoMath.ToRadians(rxVal - lastRx);
double deltaRy = RhinoMath.ToRadians(ryVal - lastRy);
double deltaRz = RhinoMath.ToRadians(rzVal - lastRz);

// Aggiorna memoria angoli
lastRx = rxVal;
lastRy = ryVal;
lastRz = rzVal;

// Rotazioni attorno ad assi locali
if (Math.Abs(deltaRx) > 1e-6)
{
  Transform rotX = Transform.Rotation(deltaRx, storedPlane.XAxis, storedPlane.Origin);
  storedPlane.Transform(rotX);
}
if (Math.Abs(deltaRy) > 1e-6)
{
  Transform rotY = Transform.Rotation(deltaRy, storedPlane.YAxis, storedPlane.Origin);
  storedPlane.Transform(rotY);
}
if (Math.Abs(deltaRz) > 1e-6)
{
  Transform rotZ = Transform.Rotation(deltaRz, storedPlane.ZAxis, storedPlane.Origin);
  storedPlane.Transform(rotZ);
}

// ⬇️ Aggiunto: sposta lungo Z globale
Plane movedPlane = new Plane(storedPlane);
movedPlane.Translate(Vector3d.ZAxis * zOffset);

// Output finale
a = movedPlane;

;
    }
}
# ---------- end c_script ----------
ellipse = Ellipse(Plane=c_script.a, Radius1=Slider(0.6, range=0..1.5), Radius2=Slider(1, range=0..1.5))  # -> Ellipse, Focus1, Focus2

a_x_2 = Slider(0, range=-180..180)
a_y_2 = Slider(30, range=-180..180)
h_1_2 = Slider(-0.7, range=-1.5..3)
a_z_2 = Slider(0, range=-180..180)
pt2 = Point(<point referenced from the Rhino model>)
c_script_2 = CSharpScript(pt=pt2, rx=a_x_2, ry=a_y_2, rz=a_z_2, zOffset=h_1_2)  # -> out, a; inputs pt: Point3d, zOffset: Double; same code as c_script
ellipse_2 = Ellipse(Plane=c_script_2.a, Radius1=Slider(0.8, range=0..1.5), Radius2=Slider(0.4, range=0..1.5))  # -> Ellipse, Focus1, Focus2

a_x_3 = Slider(-35, range=-180..180)
a_y_3 = Slider(0, range=-180..180)
h_1_3 = Slider(0, range=-1.5..3)
a_z_3 = Slider(0, range=-180..180)
pt3 = Point(<point referenced from the Rhino model>)
c_script_3 = CSharpScript(pt=pt3, rx=a_x_3, ry=a_y_3, rz=a_z_3, zOffset=h_1_3)  # -> out, a; inputs pt: Point3d, zOffset: Double; same code as c_script
ellipse_3 = Ellipse(Plane=c_script_3.a, Radius1=Slider(0.5, range=0..1.5), Radius2=Slider(0.9, range=0..1.5))  # -> Ellipse, Focus1, Focus2

# ----
crv = Curve(<curve referenced from the Rhino model>)
crv_2 = Curve(<curve referenced from the Rhino model>)
crv_3 = Curve(<curve referenced from the Rhino model>)

# ---- group: POINT CLASSIFICATION (ALSO THROUGH C#
number_slider = Slider(10000, range=0..10000)

# ---- group: flaps_withot holes
c_script_4 = CSharpScript(
    baseScale=Slider(1, range=0..1),
    flapHeight=Slider(0.097, range=0..0.2),
    materialThickness=Slider(0.032, range=0..0.1),
    holeDistanceFromEdge=Slider(0.05, range=0..0.1),
    holeDiameter=Slider(0.02, range=0..0.1))  # -> out, Flaps, Holes; inputs ngonFaces: list of Polyline, mesh: Mesh, baseScale: Double, flapHeight: Double, materialThickness: Double, holeDistanceFromEdge: Double, holeDiameter: Double
# ---------- c_script_4: C# ----------
// Grasshopper Script Instance
#region Usings
using System;
using System.Linq;
using System.Collections;
using System.Collections.Generic;
using System.Drawing;

using Rhino;
using Rhino.Geometry;

using Grasshopper;
using Grasshopper.Kernel;
using Grasshopper.Kernel.Data;
using Grasshopper.Kernel.Types;
using System;
using System.Collections.Generic;
using Rhino;
using Rhino.Geometry;
#endregion


public class Script_Instance : GH_ScriptInstance
{
  private void RunScript(
	List<Polyline> ngonFaces,
	Mesh mesh,
	double baseScale,
	double flapHeight,
	double materialThickness,
	double holeDistanceFromEdge,
	double holeDiameter,
	ref object Flaps,
	ref object Holes)
  {
    List<Polyline> flaps = new List<Polyline>();
    List<Point3d> holes = new List<Point3d>();
    Dictionary<Polyline, Vector3d> ngonNormals = new Dictionary<Polyline, Vector3d>();

    foreach (Polyline face in ngonFaces)
    {
      if (face == null || face.Count < 3) continue;

      Plane plane;
      Plane.FitPlaneToPoints(face, out plane);
      Vector3d normal = plane.Normal;
      normal.Unitize();

      if (Vector3d.Multiply(normal, Vector3d.ZAxis) < 0) normal.Reverse();

      ngonNormals[face] = normal;
    }

    foreach (Polyline face in ngonFaces)
    {
      if (face == null || face.Count < 3 || !ngonNormals.ContainsKey(face)) continue;

      Vector3d normal = ngonNormals[face];
      int count = face.Count - 1;

      for (int i = 0; i < count; i++)
      {
        Point3d pt0 = face[i];
        Point3d pt1 = face[i + 1];

        Line edge = new Line(pt0, pt1);
        Vector3d edgeDir = edge.Direction;
        edgeDir.Unitize();

        List<Vector3d> nearbyNormals = new List<Vector3d>();
        foreach (Polyline other in ngonFaces)
        {
          if (other == face || !ngonNormals.ContainsKey(other)) continue;
          if (IsCloseToPolyline(pt0, other) || IsCloseToPolyline(pt1, other))
            nearbyNormals.Add(ngonNormals[other]);
        }

        Vector3d avgNormal = nearbyNormals.Count > 0 ?
          Vector3d.Divide(nearbyNormals.Aggregate((a, b) => a + b), nearbyNormals.Count) : normal;
        avgNormal.Unitize();

        Vector3d flapDir = Vector3d.CrossProduct(edgeDir, avgNormal);
        if (!flapDir.IsValid || flapDir.IsZero) continue;
        flapDir.Unitize();

        double baseLen = pt0.DistanceTo(pt1);
        double flapWidth = baseLen * baseScale;
        Point3d mid = edge.PointAt(0.5);

        Plane flapPlane = new Plane(mid, edgeDir, flapDir);
        Transform toWorld = Transform.PlaneToPlane(Plane.WorldXY, flapPlane);

        Point3d p0 = new Point3d(-flapWidth / 2, 0, 0);
        Point3d p1 = new Point3d(flapWidth / 2, 0, 0);
        Point3d p2 = new Point3d(flapWidth / 2, 0, flapHeight);
        Point3d p3 = new Point3d(-flapWidth / 2, 0, flapHeight);

        p0.Transform(toWorld);
        p1.Transform(toWorld);
        p2.Transform(toWorld);
        p3.Transform(toWorld);

        flaps.Add(new Polyline(new List<Point3d> { p0, p1, p2, p3, p0 }));

        // === Creazione dei fori ===
        Point3d h1 = new Point3d(0, 0, holeDistanceFromEdge);
        Point3d h2 = new Point3d(0, 0, flapHeight - holeDistanceFromEdge);

        h1.Transform(toWorld);
        h2.Transform(toWorld);

        holes.Add(h1);
        holes.Add(h2);
      }
    }

    Flaps = flaps;
    Holes = holes;
  }

  private bool IsCloseToPolyline(Point3d pt, Polyline poly)
  {
    foreach (var p in poly)
      if (pt.DistanceTo(p) < RhinoDoc.ActiveDoc.ModelAbsoluteTolerance)
        return true;
    return false;
  }
}
# ---------- end c_script_4 ----------

# ----
number_slider_2 = Slider(0, range=0..0.1)
number_slider_3 = Slider(0.042, range=0..0.1)
number_slider_4 = Slider(0, range=0..0.1)
number_slider_5 = Slider(0.017, range=0..0.1)
number_slider_6 = Slider(0.9, range=0..1)
number_slider_7 = Slider(0.1, range=0..0.2)

number_slider_8 = Slider(0.042, range=0..0.1)
number_slider_9 = Slider(0.023, range=0..0.1)

number_slider_10 = Slider(0.036, range=0..0.1)
number_slider_11 = Slider(0.039, range=0..0.1)
number_slider_12 = Slider(0.04, range=0..0.1)
number_slider_13 = Slider(0.109, range=0..0.2)
number_slider_14 = Slider(0.84, range=0..1)

# ---- group: Sistema interattivo di controllo e contenimento di ellissi orientate nello spazio entro un perimetro planare
project = Project(Geometry=ellipse_3.Ellipse, Plane=PlaneXY(0, 0, 0))  # -> Geometry, Transform
area = Area(Geometry=project.Geometry)  # -> Area, Centroid
pt_2 = Point(<point referenced from the Rhino model>)
dpipeline = DynamicGeometryPipeline(
    LayerFilter="Livello 05",
    TypeFilter="Point",
    NameFilter="3",
    GroupByLayer=False,
    GroupByType=False,
    IncludeHidden=True,
    IncludeLocked=True,
    enableFullPath=False,
    listenToAttributes=True)
vec2pt = Vector2Pt(PointA=area.Centroid, PointB=pt_2, Unitize=False)  # -> Vector, Length
move = Move(Geometry=project.Geometry, Motion=vec2pt.Vector)  # -> Geometry, Transform

project_2 = Project(Geometry=ellipse.Ellipse, Plane=PlaneXY(0, 0, 0))  # -> Geometry, Transform
area_2 = Area(Geometry=project_2.Geometry)  # -> Area, Centroid
pt_3 = Point(<point referenced from the Rhino model>)
dpipeline_2 = DynamicGeometryPipeline(
    LayerFilter="Livello 05",
    TypeFilter="Point",
    NameFilter="1",
    GroupByLayer=False,
    GroupByType=False,
    IncludeHidden=True,
    IncludeLocked=True,
    enableFullPath=False,
    listenToAttributes=True)
vec2pt_2 = Vector2Pt(PointA=area_2.Centroid, PointB=pt_3, Unitize=False)  # -> Vector, Length
move_2 = Move(Geometry=project_2.Geometry, Motion=vec2pt_2.Vector)  # -> Geometry, Transform

# ----
merge = Merge(Data1=move_2.Geometry, Data2=move.Geometry)

# ---- group: Sistema interattivo di controllo e contenimento di ellissi orientate nello spazio entro un perimetro planare
project_3 = Project(Geometry=ellipse_2.Ellipse, Plane=PlaneXY(0, 0, 0))  # -> Geometry, Transform
area_3 = Area(Geometry=project_3.Geometry)  # -> Area, Centroid
pt_4 = Point(<point referenced from the Rhino model>)
dpipeline_3 = DynamicGeometryPipeline(
    LayerFilter="Livello 05",
    TypeFilter="Point",
    NameFilter="2",
    GroupByLayer=False,
    GroupByType=False,
    IncludeHidden=True,
    IncludeLocked=True,
    enableFullPath=False,
    listenToAttributes=True)
vec2pt_3 = Vector2Pt(PointA=area_3.Centroid, PointB=pt_4, Unitize=False)  # -> Vector, Length
move_3 = Move(Geometry=project_3.Geometry, Motion=vec2pt_3.Vector)  # -> Geometry, Transform
c_script_5 = CSharpScript(
    EllipseCRV=move_3.Geometry,
    CrvBoundary=crv,
    intDivisions=Slider(50, range=0..100),
    origin_pt3d=area_3.Centroid,
    originObjID=dpipeline_3,
    otherEllipses=merge)  # -> out, a, b; inputs originObjID: Guid, otherEllipses: list of Curve
# ---------- c_script_5: C# ----------
// Grasshopper Script Instance
#region Usings
using System;
using System.Linq;
using System.Collections;
using System.Collections.Generic;
using System.Drawing;

using Rhino;
using Rhino.Geometry;

using Grasshopper;
using Grasshopper.Kernel;
using Grasshopper.Kernel.Data;
using Grasshopper.Kernel.Types;
#endregion

public class Script_Instance : GH_ScriptInstance
{
    #region Notes
    /* 
      Members:
        RhinoDoc RhinoDocument
        GH_Document GrasshopperDocument
        IGH_Component Component
        int Iteration

      Methods (Virtual & overridable):
        Print(string text)
        Print(string format, params object[] args)
        Reflect(object obj)
        Reflect(object obj, string method_name)
    */
    #endregion

private void RunScript(
	object EllipseCRV,
	object CrvBoundary,
	object intDivisions,
	object origin_pt3d,
	Guid originObjID,
	List<Curve> otherEllipses,
	ref object a,
	ref object b)
{
  Curve ellipseCrv = EllipseCRV as Curve;
  Curve boundary = CrvBoundary as Curve;
  int divisions = Convert.ToInt32(intDivisions);
  Point3d origin = (Point3d) origin_pt3d;
  Guid objID = (Guid) originObjID;

  if (ellipseCrv == null || boundary == null || !ellipseCrv.IsClosed || !boundary.IsClosed)
  {
    a = "Input non valido.";
    b = null;
    return;
  }

  double[] tParams = ellipseCrv.DivideByCount(divisions, true);
  List<Point3d> pts = tParams.Select(t => ellipseCrv.PointAt(t)).ToList();
  Point3d centroid = new Point3d(
    pts.Average(p => p.X),
    pts.Average(p => p.Y),
    pts.Average(p => p.Z)
  );

  bool hasOutside = pts.Any(pt =>
    boundary.Contains(pt, Plane.WorldXY, RhinoDoc.ActiveDoc.ModelAbsoluteTolerance) != PointContainment.Inside);

  bool intersectsOther = false;
  if (otherEllipses != null)
  {
    foreach (Curve other in otherEllipses)
    {
      if (other == null || other == ellipseCrv) continue;
      var ccx = Rhino.Geometry.Intersect.Intersection.CurveCurve(ellipseCrv, other, 0.01, 0.01);
      if (ccx.Count > 0)
      {
        intersectsOther = true;
        break;
      }
    }
  }

  if (hasOutside || intersectsOther)
  {
    Vector3d moveVec = origin - centroid;

    Curve moved = ellipseCrv.DuplicateCurve();
    moved.Transform(Transform.Translation(moveVec));
    a = moved;

    var rhObj = RhinoDoc.ActiveDoc.Objects.Find(objID);
    if (rhObj != null)
    {
      Transform movePt = Transform.Translation(moveVec);
      RhinoDoc.ActiveDoc.Objects.Transform(rhObj, movePt, true);
      RhinoDoc.ActiveDoc.Views.Redraw();
    }

    b = origin;
  }
  else
  {
    a = ellipseCrv;
    b = origin;
  }
}





}
# ---------- end c_script_5 ----------

# ----
merge_2 = Merge(Data1=move_3.Geometry, Data2=move_2.Geometry)
merge_3 = Merge(Data1=move_3.Geometry, Data2=move.Geometry)

# ---- group: Sistema interattivo di controllo e contenimento di ellissi orientate nello spazio entro un perimetro planare (continued)
c_script_6 = CSharpScript(
    EllipseCRV=move_2.Geometry,
    CrvBoundary=crv_3,
    intDivisions=Slider(50, range=0..100),
    origin_pt3d=area_2.Centroid,
    originObjID=dpipeline_2,
    otherEllipses=merge_3)  # -> out, a, b; inputs originObjID: Guid, otherEllipses: list of Curve; same code as c_script_5

c_script_7 = CSharpScript(
    EllipseCRV=move.Geometry,
    CrvBoundary=crv_2,
    intDivisions=Slider(50, range=0..100),
    origin_pt3d=area.Centroid,
    originObjID=dpipeline,
    otherEllipses=merge_2)  # -> out, a, b; inputs originObjID: Guid, otherEllipses: list of Curve; same code as c_script_5

# ---- group: Mesh base da tirare con Kangaroo
merge_4 = Merge(Data1=c_script_6.a, Data2=c_script_5.a, Data3=c_script_7.a)
crv_4 = Curve(<curve referenced from the Rhino model>)
pl = ConstructPlane(Origin=Point(0, 0, 0), XAxis=Vector(1, 0, 0), YAxis=Vector(0, 1, 0))
rdiff = RegionDifference(CurvesA=crv_4, CurvesB=merge_4, Plane=pl)
boundary = BoundarySurfaces(Edges=rdiff)
triremesh = TriRemesh(Geometry=boundary, Sharp=Toggle(True), Length=Slider(0.3, range=0..1), Iterations=Slider(95, range=0..100))  # -> Triangulation, Dual, Creases

# ---- group: POINT CLASSIFICATION (ALSO THROUGH C#
number_slider_15 = Slider(0.037, range=0..0.1)
crv_5 = Curve([<curve referenced from the Rhino model> x2])
mesh = Mesh(triremesh.Triangulation)
pt_5 = Point(<point referenced from the Rhino model>)
top = GetPolylines(Mesh=mesh)
graft = GraftTree(Tree=top, IncludeEmptyLists=True, IncludeNullItems=True)
number_slider_16 = Slider(10000, range=0..10000)
explode = Explode(Curve=graft, Recursive=True)  # -> Segments, Vertices

# ---- group: POINT CLASSIFICATION (ALSO THROUGH C# / MESH_PT_FILTER AND CLASSIFIER
c_script_8 = CSharpScript(meshHex=mesh, referencePt=pt_5, anchorCurves=crv_5, tolerance=number_slider_15)  # -> out, a, b, c; inputs meshHex: Mesh, referencePt: Point3d, anchorCurves: list of Curve, tolerance: Double
# ---------- c_script_8: C# ----------
// Grasshopper Script Instance
#region Usings
using System;
using System.Linq;
using System.Collections;
using System.Collections.Generic;
using System.Drawing;

using Rhino;
using Rhino.Geometry;

using Grasshopper;
using Grasshopper.Kernel;
using Grasshopper.Kernel.Data;
using Grasshopper.Kernel.Types;
#endregion

public class Script_Instance : GH_ScriptInstance
{
  private void RunScript(
	Mesh meshHex,
	Point3d referencePt,
	List<Curve> anchorCurves,
	double tolerance,
	ref object a,
	ref object b,
	ref object c)
  {
    if (meshHex == null || !meshHex.IsValid)
    {
      a = "Mesh non valida.";
      b = null;
      return;
    }

    var nakedEdges = new List<Curve>();

    for (int i = 0; i < meshHex.TopologyEdges.Count; i++)
    {
      int[] faces = meshHex.TopologyEdges.GetConnectedFaces(i);
      if (faces.Length == 1)
      {
        Line l = meshHex.TopologyEdges.EdgeLine(i);
        nakedEdges.Add(new LineCurve(l));
      }
    }

    Curve[] joined = Curve.JoinCurves(nakedEdges);
    if (joined.Length == 0)
    {
      a = "Impossibile unire i bordi.";
      b = null;
      return;
    }

    // Trova la curva più lunga → bordo esterno
    Curve longest = joined[0];
    double maxLength = longest.GetLength();
    int longestIndex = 0;

    for (int i = 1; i < joined.Length; i++)
    {
      double len = joined[i].GetLength();
      if (len > maxLength)
      {
        longest = joined[i];
        maxLength = len;
        longestIndex = i;
      }
    }

    // Esplodi bordo esterno
    Polyline outerPoly;
    if (!longest.TryGetPolyline(out outerPoly))
    {
      a = "Errore nel convertire il bordo in polyline.";
      b = null;
      return;
    }

    // Separazione punti bordo esterno: ancorati vs liberi
    List<Point3d> anchoredPts = new List<Point3d>();
    List<Point3d> freePts = new List<Point3d>();

    foreach (Point3d pt in outerPoly)
    {
      bool isAnchored = false;
      Point3d ptFlat = new Point3d(pt.X, pt.Y, 0);

      foreach (Curve crv in anchorCurves)
      {
        double t;
        crv.ClosestPoint(pt, out t);
        Point3d closest = crv.PointAt(t);
        Point3d closestFlat = new Point3d(closest.X, closest.Y, 0);

        if (ptFlat.DistanceTo(closestFlat) <= tolerance)
        {
          isAnchored = true;
          break;
        }

        Polyline crvPoly;
        if (crv.TryGetPolyline(out crvPoly))
        {
          foreach (Point3d corner in crvPoly)
          {
            Point3d cornerFlat = new Point3d(corner.X, corner.Y, 0);
            if (ptFlat.DistanceTo(cornerFlat) <= tolerance)
            {
              isAnchored = true;
              break;
            }
          }
        }

        if (isAnchored)
          break;
      }

      if (isAnchored)
        anchoredPts.Add(pt);
      else
        freePts.Add(pt);
    }

    // Rimuove duplicati
    anchoredPts = RemoveDuplicates(anchoredPts, tolerance);
    freePts = RemoveDuplicates(freePts, tolerance);

    a = anchoredPts;

    // Analizza i bordi interni (oculi) e ordina per distanza dal punto di riferimento
    var tempOculi = new List<(double dist, List<Point3d> pts)>();

    for (int i = 0; i < joined.Length; i++)
    {
      if (i == longestIndex) continue;

      Polyline pl;
      if (joined[i].TryGetPolyline(out pl))
      {
        double dist = pl.ToList().Average(p => p.DistanceTo(referencePt));
        tempOculi.Add((dist, pl.ToList()));
      }
    }

    tempOculi.Sort((a, b) => a.dist.CompareTo(b.dist));

    var tree = new DataTree<Point3d>();
    for (int i = 0; i < tempOculi.Count; i++)
    {
      GH_Path path = new GH_Path(i);
      foreach (Point3d pt in tempOculi[i].pts)
      {
        tree.Add(pt, path);
      }
    }

    b = tree;
    c = freePts;
  }

  // 🔧 Funzione helper per rimuovere duplicati con tolleranza
  private List<Point3d> RemoveDuplicates(List<Point3d> points, double tol)
  {
    var unique = new List<Point3d>();
    foreach (var pt in points)
    {
      bool isDuplicate = false;
      foreach (var existing in unique)
      {
        if (pt.DistanceTo(existing) <= tol)
        {
          isDuplicate = true;
          break;
        }
      }
      if (!isDuplicate)
        unique.Add(pt);
    }
    return unique;
  }
}
# ---------- end c_script_8 ----------

# ---- group: POINT CLASSIFICATION (ALSO THROUGH C# / AGGANCIO PORTALI
pt_6 = Point(c_script_8.c)
c_script_9 = CSharpScript(points=pt_6, referencePt=pt2)  # -> out, smallerX, greaterX; inputs points: list of Point3d, referencePt: Point3d
# ---------- c_script_9: C# ----------
// Grasshopper Script Instance
#region Usings
using System;
using System.Linq;
using System.Collections;
using System.Collections.Generic;
using System.Drawing;

using Rhino;
using Rhino.Geometry;

using Grasshopper;
using Grasshopper.Kernel;
using Grasshopper.Kernel.Data;
using Grasshopper.Kernel.Types;
#endregion

public class Script_Instance : GH_ScriptInstance
{
    #region Notes
    /* 
      Members:
        RhinoDoc RhinoDocument
        GH_Document GrasshopperDocument
        IGH_Component Component
        int Iteration

      Methods (Virtual & overridable):
        Print(string text)
        Print(string format, params object[] args)
        Reflect(object obj)
        Reflect(object obj, string method_name)
    */
    #endregion

    private void RunScript(
	List<Point3d> points,
	Point3d referencePt,
	ref object smallerX,
	ref object greaterX)
{
  List<Point3d> listSmaller = new List<Point3d>();
  List<Point3d> listGreater = new List<Point3d>();

  foreach (Point3d pt in points)
  {
    if (pt.X < referencePt.X)
      listSmaller.Add(pt);
    else
      listGreater.Add(pt);
  }

  smallerX = listSmaller;
  greaterX = listGreater;
}

}
# ---------- end c_script_9 ----------
number_slider_17 = Slider(-45, range=-180..180)
crv_6 = Curve(<curve referenced from the Rhino model>)
crv_7 = Curve(<curve referenced from the Rhino model>)
c_script_10 = CSharpScript(pts=c_script_9.greaterX, axisCrv=crv_7, angleDeg=number_slider_17)  # -> out, rotatedPts; inputs pts: list of Point3d, axisCrv: Curve, angleDeg: Double
# ---------- c_script_10: C# ----------
// Grasshopper Script Instance
#region Usings
using System;
using System.Linq;
using System.Collections;
using System.Collections.Generic;
using System.Drawing;

using Rhino;
using Rhino.Geometry;

using Grasshopper;
using Grasshopper.Kernel;
using Grasshopper.Kernel.Data;
using Grasshopper.Kernel.Types;
#endregion

public class Script_Instance : GH_ScriptInstance
{
    #region Notes
    /* 
      Members:
        RhinoDoc RhinoDocument
        GH_Document GrasshopperDocument
        IGH_Component Component
        int Iteration

      Methods (Virtual & overridable):
        Print(string text)
        Print(string format, params object[] args)
        Reflect(object obj)
        Reflect(object obj, string method_name)
    */
    #endregion

    private void RunScript(
	List<Point3d> pts,
	Curve axisCrv,
	double angleDeg,
	ref object rotatedPts)
{
  if (axisCrv == null || !axisCrv.IsValid)
  {
    rotatedPts = "Curva non valida.";
    return;
  }

  Point3d axisStart = axisCrv.PointAtStart;
  Point3d axisEnd = axisCrv.PointAtEnd;

  Vector3d axis = axisEnd - axisStart;
  if (axis.IsZero)
  {
    rotatedPts = "Asse di rotazione nullo (start = end)";
    return;
  }

  axis.Unitize();
  double angleRad = Rhino.RhinoMath.ToRadians(angleDeg);

  Transform rotation = Transform.Rotation(angleRad, axis, axisStart);

  List<Point3d> result = new List<Point3d>();
  foreach (Point3d pt in pts)
  {
    Point3d rotated = pt;
    rotated.Transform(rotation);
    result.Add(rotated);
  }

  rotatedPts = result;
}

}
# ---------- end c_script_10 ----------
c_script_11 = CSharpScript(pts=c_script_9.smallerX, axisCrv=crv_6, angleDeg=number_slider_17)  # -> out, rotatedPts; inputs pts: list of Point3d, axisCrv: Curve, angleDeg: Double; same code as c_script_10

# ---- group: POINT CLASSIFICATION (ALSO THROUGH C# (continued)
bang = ExplodeTree(Data=c_script_8.b)  # -> Branch0, Branch1, Branch2

# ---- group: POINT CLASSIFICATION (ALSO THROUGH C# / TRANSPOSIZIONE DEI PUNTI DEI FORI ELICOIDALI
vec2pt_4 = Vector2Pt(PointA=pt_2, PointB=c_script_7.b, Unitize=False)  # -> Vector, Length
vec2pt_5 = Vector2Pt(PointA=pt_4, PointB=c_script_5.b, Unitize=False)  # -> Vector, Length
vec2pt_6 = Vector2Pt(PointA=pt_3, PointB=c_script_6.b, Unitize=False)  # -> Vector, Length
move_4 = Move(Geometry=bang.Branch2, Motion=vec2pt_4.Vector)  # -> Geometry, Transform
move_5 = Move(Geometry=bang.Branch0, Motion=vec2pt_6.Vector)  # -> Geometry, Transform
move_6 = Move(Geometry=bang.Branch1, Motion=vec2pt_5.Vector)  # -> Geometry, Transform
projecta = ProjectAlong(Geometry=move_5.Geometry, Plane=ellipse.Ellipse, Direction=Vector(0, 0, -1))  # -> Geometry, Transform
projecta_2 = ProjectAlong(Geometry=move_4.Geometry, Plane=ellipse_3.Ellipse, Direction=Vector(0, 0, -1))  # -> Geometry, Transform
projecta_3 = ProjectAlong(Geometry=move_6.Geometry, Plane=ellipse_2.Ellipse, Direction=Vector(0, 0, -1))  # -> Geometry, Transform

# ---- group: POINT CLASSIFICATION (ALSO THROUGH C#
pt_7 = Point(projecta.Geometry)
pt_8 = Point(projecta_3.Geometry)
pt_9 = Point(projecta_2.Geometry)

pt_10 = Point(c_script_10.rotatedPts)
pt_11 = Point(c_script_11.rotatedPts)

# ---- group: FORMA ATTRAVERSO KANGAROO / VINCOLI
anchor = Anchor(Point=bang.Branch0, Target=pt_7, Strength=number_slider)
anchor_2 = Anchor(Point=bang.Branch1, Target=pt_8, Strength=number_slider)
anchor_3 = Anchor(Point=bang.Branch2, Target=pt_9, Strength=number_slider)

anchor_4 = Anchor(Point=c_script_9.smallerX, Target=pt_11, Strength=number_slider_16)
anchor_5 = Anchor(Point=c_script_9.greaterX, Target=pt_10, Strength=number_slider_16)

show = Show(G=mesh)

# ---- group: FORMA ATTRAVERSO KANGAROO
anchor_6 = Anchor(Point=c_script_8.a, Strength=number_slider_16)
length_line = LengthLine(Line=explode.Segments, Strength=10)
merge_5 = Merge(
    Data1=length_line,
    Data2=show,
    Data3=anchor_6,
    Data6=anchor,
    Data7=anchor_2,
    Data8=anchor_3,
    Data9=anchor_4,
    Data10=anchor_5)
solver = Solver(GoalObjects=merge_5, Reset=Button(), Threshold=1e-15, Tolerance=0.01, On=Toggle(True))  # -> I, V, O
bang_2 = ExplodeTree(Data=solver.O)  # -> Branch0, Branch1, _0000, _000000

# ----
# Suggestion, don't connect.
# Elaborate the first part,
# internalize it in the second part (mesh) and disconnect from Exlore tree. Never close the circuit.
mesh_2 = Mesh(bang_2.Branch1)
mesh_3 = Mesh(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)

unifynormals = MeshUnifyNormals(Mesh=mesh_3)
unim = UnifyMesh(Mesh=unifynormals)  # -> Result, Count

# ---- group: 2° attempt _singularities
qrsettings = QuadRemeshSettings(
    TargetCount=Slider(1000, range=0..2000),
    AdaptiveSize=Slider(100, range=0..100),
    AdaptiveCount=Toggle(True),
    HardEdges=False,
    SeamEdges=Slider(2, range=0..2),
    Symmetry=0,
    GuideCurves=Slider(2, range=0..2))
qrmesh = QuadRemesh(Geometry=unim.Result, Settings=qrsettings)
wbloop = WeaverbirdsLoopSubdivision(MeshCurves=qrmesh, Level=1, SmoothNakedEdges=1)
triremesh_2 = TriRemesh(Geometry=wbloop, Length=Slider(0.393, range=0..1), Iterations=25)  # -> Triangulation, Dual, Creases
dual = Dual(Mesh=triremesh_2.Triangulation, Type=0)

# ---- group: 1° attempt
triremesh_3 = TriRemesh(Geometry=unim.Result, Length=Slider(0.2, range=0..1), Iterations=25)  # -> Triangulation, Dual, Creases
dual_2 = Dual(Mesh=triremesh_3.Triangulation, Type=0)

# ---- group: 2° attempt _singularities / singularities ≠ 4
# Of course outside edges of the shape and vertex with more than 4 quadmesh shared
c_script_12 = CSharpScript(M=qrmesh)  # -> out, a, b, c; inputs M: Mesh
# ---------- c_script_12: C# ----------
// Grasshopper Script Instance
#region Usings
using System;
using System.Linq;
using System.Collections;
using System.Collections.Generic;
using System.Drawing;

using Rhino;
using Rhino.Geometry;

using Grasshopper;
using Grasshopper.Kernel;
using Grasshopper.Kernel.Data;
using Grasshopper.Kernel.Types;
#endregion

public class Script_Instance : GH_ScriptInstance
{
    #region Notes
    /* 
      Members:
        RhinoDoc RhinoDocument
        GH_Document GrasshopperDocument
        IGH_Component Component
        int Iteration

      Methods (Virtual & overridable):
        Print(string text)
        Print(string format, params object[] args)
        Reflect(object obj)
        Reflect(object obj, string method_name)
    */
    #endregion

    private void RunScript(Mesh M, ref object a, ref object b, ref object c)
{
  List<Point3d> regular = new List<Point3d>();
  List<Point3d> singular = new List<Point3d>();
  List<int> valences = new List<int>();

  if (M == null) return;

  // Analizza ogni vertice
  for (int i = 0; i < M.Vertices.Count; i++)
  {
    int[] connectedFaces = M.TopologyVertices.ConnectedFaces(i);
    int valence = connectedFaces.Length;

    valences.Add(valence);

    Point3d pt = M.Vertices[i];

    if (valence == 4)
      regular.Add(pt);
    else
      singular.Add(pt);
  }

  a = regular;
  b = singular;
  c = valences;
}

}
# ---------- end c_script_12 ----------
panel = Panel(c_script_12.c)
preview = CustomPreview(
    Geometry=c_script_12.b,
    Material={diffuse=RGB(221, 160, 221), emission=RGB(66, 48, 66), shine=0.5, specular=RGB(255, 255, 255), transparency=0})
preview_2 = CustomPreview(
    Geometry=c_script_12.a,
    Material={diffuse=RGB(221, 160, 221), emission=RGB(66, 48, 66), shine=0.5, specular=RGB(255, 255, 255), transparency=0})

# ----
mesh_4 = Mesh(dual)

# ---- group: Attempts
number_slider_18 = Slider(0, range=0..180)
number_slider_19 = Slider(0.91, range=0..1)
number_slider_20 = Slider(0.2, range=0..0.2)
c_script_13 = CSharpScript()  # -> out, tabs; inputs faces: list of Polyline, mesh: Mesh, length: Double, scale: Double, foldAngleDegrees: Double
# ---------- c_script_13: C# ----------
using System;
using System.Collections.Generic;
using Rhino;
using Rhino.Geometry;

public class Script_Instance : GH_ScriptInstance
{
  private void RunScript(
	List<Polyline> faces,
	Mesh mesh,
	double length,
	double scale,
	double foldAngleDegrees,
	ref object tabs)
  {
    List<Polyline> outputTabs = new List<Polyline>();
    Dictionary<string, List<Vector3d>> edgeNormals = new Dictionary<string, List<Vector3d>>();

    Func<Point3d, Point3d, string> edgeKey = (p1, p2) => {
      return p1.CompareTo(p2) < 0
        ? $"{p1.X:F4},{p1.Y:F4},{p1.Z:F4}-{p2.X:F4},{p2.Y:F4},{p2.Z:F4}"
        : $"{p2.X:F4},{p2.Y:F4},{p2.Z:F4}-{p1.X:F4},{p1.Y:F4},{p1.Z:F4}";
    };

    foreach (Polyline face in faces)
    {
      if (face == null || face.Count < 3) continue;

      for (int i = 0; i < face.Count - 1; i++)
      {
        Point3d pt1 = face[i];
        Point3d pt2 = face[i + 1];
        string key = edgeKey(pt1, pt2);

        Point3d midpoint = new Line(pt1, pt2).PointAt(0.5);
        MeshPoint mp = mesh.ClosestMeshPoint(midpoint, 0.01);
        if (mp == null) continue;

        Vector3d normal = mesh.NormalAt(mp);
        if (!normal.IsValid) continue;

        if (!edgeNormals.ContainsKey(key))
          edgeNormals[key] = new List<Vector3d>();

        edgeNormals[key].Add(normal);
      }
    }

    double foldAngleRad = RhinoMath.ToRadians(foldAngleDegrees);

    foreach (Polyline face in faces)
    {
      if (face == null || face.Count < 3) continue;

      for (int i = 0; i < face.Count - 1; i++)
      {
        Point3d pt1 = face[i];
        Point3d pt2 = face[i + 1];
        string key = edgeKey(pt1, pt2);
        if (!edgeNormals.ContainsKey(key)) continue;

        List<Vector3d> normals = edgeNormals[key];
        if (normals.Count == 0) continue;

        Vector3d bisector = Vector3d.Zero;
        foreach (Vector3d n in normals) bisector += n;
        bisector.Unitize();

        Line edge = new Line(pt1, pt2);
        Vector3d edgeDir = edge.Direction;
        edgeDir.Unitize();

        Vector3d foldDir = Vector3d.CrossProduct(edgeDir, bisector);
        if (!foldDir.IsValid || foldDir.IsZero) continue;
        foldDir.Unitize();

        double edgeLength = edge.Length;
        double halfW = (edgeLength * scale) / 2.0;

        // Linguetta iniziale in XY
        Point3d p0 = new Point3d(-halfW, 0, 0);
        Point3d p1 = new Point3d(halfW, 0, 0);
        Point3d p2 = new Point3d(halfW, 0, length);
        Point3d p3 = new Point3d(-halfW, 0, length);

        // Rotazione piega
        Transform foldRot = Transform.Rotation(foldAngleRad, Vector3d.XAxis, Point3d.Origin);
        p2.Transform(foldRot);
        p3.Transform(foldRot);

        // Posizione nello spazio
        Point3d mid = edge.PointAt(0.5);
        Plane localPlane = new Plane(mid, edgeDir, foldDir);
        Transform orient = Transform.PlaneToPlane(Plane.WorldXY, localPlane);

        // Clona i punti per test
        Point3d tp0 = p0;
        Point3d tp1 = p1;
        Point3d tp2 = p2;
        Point3d tp3 = p3;
        tp0.Transform(orient);
        tp1.Transform(orient);
        tp2.Transform(orient);
        tp3.Transform(orient);

        // Test direzione linguetta → se \"fuori\", inverti foldDir
        Point3d center = 0.5 * (tp2 + tp3);
        Vector3d testVec = center - mid;
        testVec.Unitize();

        if (Vector3d.Multiply(testVec, bisector) > 0)
        {
          foldDir.Reverse();
          localPlane = new Plane(mid, edgeDir, foldDir);
          orient = Transform.PlaneToPlane(Plane.WorldXY, localPlane);

          tp0 = p0;
          tp1 = p1;
          tp2 = p2;
          tp3 = p3;
          tp0.Transform(orient);
          tp1.Transform(orient);
          tp2.Transform(orient);
          tp3.Transform(orient);
        }

        outputTabs.Add(new Polyline(new List<Point3d> { tp0, tp1, tp2, tp3, tp0 }));
      }
    }

    tabs = outputTabs;
  }
}
# ---------- end c_script_13 ----------
c_script_14 = CSharpScript()  # -> out, tabs; inputs faces: list of Polyline, mesh: Mesh, length: Double, scale: Double, foldAngleDegrees: Double
# ---------- c_script_14: C# ----------
using System;
using System.Collections.Generic;
using Rhino;
using Rhino.Geometry;

public class Script_Instance : GH_ScriptInstance
{
  private void RunScript(
	List<Polyline> faces,
	Mesh mesh,
	double length,
	double scale,
	double foldAngleDegrees,
	ref object tabs)
  {
    List<Polyline> outputTabs = new List<Polyline>();
    Dictionary<string, List<Vector3d>> edgeNormals = new Dictionary<string, List<Vector3d>>();
    Dictionary<Polyline, Vector3d> faceDirections = new Dictionary<Polyline, Vector3d>();

    Func<Point3d, Point3d, string> edgeKey = (p1, p2) => {
      return p1.CompareTo(p2) < 0
        ? $"{p1.X:F4},{p1.Y:F4},{p1.Z:F4}-{p2.X:F4},{p2.Y:F4},{p2.Z:F4}"
        : $"{p2.X:F4},{p2.Y:F4},{p2.Z:F4}-{p1.X:F4},{p1.Y:F4},{p1.Z:F4}";
    };

    foreach (Polyline face in faces)
    {
      if (face == null || face.Count < 3) continue;

      Plane facePlane;
      Plane.FitPlaneToPoints(face, out facePlane);

      Vector3d faceNormal = facePlane.Normal;
      faceNormal.Unitize();

      // Confronta con la Z globale
      Vector3d globalZ = Vector3d.ZAxis;
      Vector3d fake = new Vector3d(globalZ);
      fake.Unitize();
      fake *= faceNormal.Length;

      Vector3d sum = faceNormal + fake;
      if (sum.Length < faceNormal.Length)
      {
        faceNormal.Reverse();
      }

      faceDirections[face] = faceNormal;
    }

    double foldAngleRad = RhinoMath.ToRadians(foldAngleDegrees);

    foreach (Polyline face in faces)
    {
      if (face == null || face.Count < 3 || !faceDirections.ContainsKey(face)) continue;

      Vector3d faceNormal = faceDirections[face];

      for (int i = 0; i < face.Count - 1; i++)
      {
        Point3d pt1 = face[i];
        Point3d pt2 = face[i + 1];
        string key = edgeKey(pt1, pt2);

        Line edge = new Line(pt1, pt2);
        Vector3d edgeDir = edge.Direction;
        edgeDir.Unitize();

        Vector3d foldDir = Vector3d.CrossProduct(edgeDir, faceNormal);
        if (!foldDir.IsValid || foldDir.IsZero) continue;
        foldDir.Unitize();

        double edgeLength = edge.Length;
        double halfW = (edgeLength * scale) / 2.0;

        // Costruzione linguetta nel piano XY
        Point3d p0 = new Point3d(-halfW, 0, 0);
        Point3d p1 = new Point3d(halfW, 0, 0);
        Point3d p2 = new Point3d(halfW, 0, length);
        Point3d p3 = new Point3d(-halfW, 0, length);

        // Ruota linguetta attorno all'asse X (piegatura)
        Transform foldRot = Transform.Rotation(foldAngleRad, Vector3d.XAxis, Point3d.Origin);
        p2.Transform(foldRot);
        p3.Transform(foldRot);

        // Costruzione piano locale
        Point3d mid = edge.PointAt(0.5);
        Plane localPlane = new Plane(mid, edgeDir, foldDir);
        Transform orient = Transform.PlaneToPlane(Plane.WorldXY, localPlane);
        p0.Transform(orient);
        p1.Transform(orient);
        p2.Transform(orient);
        p3.Transform(orient);

        outputTabs.Add(new Polyline(new List<Point3d> { p0, p1, p2, p3, p0 }));
      }
    }

    tabs = outputTabs;
  }
}
# ---------- end c_script_14 ----------
c_script_15 = CSharpScript(baseScale=Slider(1, range=0..1), flapHeight=Slider(0.116, range=0..0.2))  # -> out, Flaps; inputs ngonFaces: list of Polyline, mesh: Mesh, baseScale: Double, flapHeight: Double
# ---------- c_script_15: C# ----------
// Grasshopper Script Instance
#region Usings
using System;
using System.Linq;
using System.Collections;
using System.Collections.Generic;
using System.Drawing;

using Rhino;
using Rhino.Geometry;

using Grasshopper;
using Grasshopper.Kernel;
using Grasshopper.Kernel.Data;
using Grasshopper.Kernel.Types;
using System;
using System.Collections.Generic;
using Rhino;
using Rhino.Geometry;
#endregion


public class Script_Instance : GH_ScriptInstance
{
  private void RunScript(
	List<Polyline> ngonFaces,
	Mesh mesh,
	double baseScale,
	double flapHeight,
	ref object Flaps)
  {
    List<Polyline> flaps = new List<Polyline>();
    Dictionary<Polyline, Vector3d> ngonNormals = new Dictionary<Polyline, Vector3d>();

    // ======= STEP 1: Calcola le normali corrette per ogni polilinea Ngon =======
    foreach (Polyline face in ngonFaces)
    {
      if (face == null || face.Count < 3)
        continue;

      Plane plane;
      Plane.FitPlaneToPoints(face, out plane);

      Vector3d normal = plane.Normal;
      normal.Unitize();

      if (Vector3d.Multiply(normal, Vector3d.ZAxis) < 0)
        normal.Reverse();

      ngonNormals[face] = normal;
    }

    // ======= STEP 2: Costruisci le alette per ogni lato =======
    foreach (Polyline face in ngonFaces)
    {
      if (face == null || face.Count < 3 || !ngonNormals.ContainsKey(face))
        continue;

      Vector3d normal = ngonNormals[face];
      int count = face.Count - 1; // polilinea chiusa

      for (int i = 0; i < count; i++)
      {
        Point3d pt0 = face[i];
        Point3d pt1 = face[i + 1];

        Line edge = new Line(pt0, pt1);
        Vector3d edgeDir = edge.Direction;
        edgeDir.Unitize();

        // Trova facce adiacenti per ciascun vertice (basato sulla distanza ai centroidi)
        List<Vector3d> nearbyNormals = new List<Vector3d>();
        Point3d midA = pt0;
        Point3d midB = pt1;

        foreach (Polyline other in ngonFaces)
        {
          if (other == face || !ngonNormals.ContainsKey(other))
            continue;

          if (IsCloseToPolyline(midA, other) || IsCloseToPolyline(midB, other))
            nearbyNormals.Add(ngonNormals[other]);
        }

        // Calcola vettore medio
        Vector3d avgNormal = new Vector3d(0, 0, 0);
        foreach (var n in nearbyNormals)
          avgNormal += n;

        if (nearbyNormals.Count > 0)
        {
          avgNormal /= nearbyNormals.Count;
        }
        else
        {
          avgNormal = normal; // fallback
        }

        avgNormal.Unitize();

        // Costruzione piano locale
        Vector3d flapDir = Vector3d.CrossProduct(edgeDir, avgNormal);
        if (!flapDir.IsValid || flapDir.IsZero)
          continue;

        flapDir.Unitize();

        // Geometria flap (trapezio rettangolo)
        double baseLen = pt0.DistanceTo(pt1);
        double flapWidth = baseLen * baseScale;
        Point3d mid = edge.PointAt(0.5);

        Plane flapPlane = new Plane(mid, edgeDir, flapDir);
        Transform toWorld = Transform.PlaneToPlane(Plane.WorldXY, flapPlane);

        Point3d p0 = new Point3d(-flapWidth / 2, 0, 0);
        Point3d p1 = new Point3d(flapWidth / 2, 0, 0);
        Point3d p2 = new Point3d(flapWidth / 2, 0, flapHeight);
        Point3d p3 = new Point3d(-flapWidth / 2, 0, flapHeight);

        p0.Transform(toWorld);
        p1.Transform(toWorld);
        p2.Transform(toWorld);
        p3.Transform(toWorld);

        flaps.Add(new Polyline(new List<Point3d> { p0, p1, p2, p3, p0 }));
      }
    }

    Flaps = flaps;
  }

  // ======= Funzione di supporto: controlla se un punto è vicino a una polilinea =======
  private bool IsCloseToPolyline(Point3d pt, Polyline poly)
  {
    foreach (var p in poly)
    {
      if (pt.DistanceTo(p) < RhinoDoc.ActiveDoc.ModelAbsoluteTolerance)
        return true;
    }
    return false;
  }
}
# ---------- end c_script_15 ----------

# ----
ngoncenters = NGonCenters(Mesh=mesh_4)  # -> Centers, Normals, Planes
top_2 = GetPolylines(Mesh=mesh_4)

# ---- group: NGON_ANG_360
# Mesures if the sum of the angles of
# each triangle around the centre
#  vertex is 360° or different and
# lists each group in 2 separete
# groups
graft_2 = GraftTree(Tree=top_2, IncludeEmptyLists=True, IncludeNullItems=True)
graft_3 = GraftTree(Tree=ngoncenters.Centers, IncludeEmptyLists=True, IncludeNullItems=True)
c_script_16 = CSharpScript(poly=graft_2, center=graft_3)  # -> out, a, b, c; inputs poly: Polyline, center: Point3d
# ---------- c_script_16: C# ----------
// Grasshopper Script Instance
#region Usings
using System;
using System.Linq;
using System.Collections;
using System.Collections.Generic;
using System.Drawing;

using Rhino;
using Rhino.Geometry;

using Grasshopper;
using Grasshopper.Kernel;
using Grasshopper.Kernel.Data;
using Grasshopper.Kernel.Types;
#endregion

public class Script_Instance : GH_ScriptInstance
{
  private void RunScript(
	Polyline poly,
	Point3d center,
	ref object a,
	ref object b,
	ref object c)
  {
    // Tolleranza (in gradi)
    double toll = 2.0;

    // Calcola somma angoli
    double angleSumRad = GetCentralAngleSum(center, poly);
    double angleSumDeg = angleSumRad * 180.0 / Math.PI;

    // Output numerico sempre
    c = angleSumDeg;

    // Condizione accettabilità
    bool isAcceptable = Math.Abs(angleSumDeg - 360.0) <= toll;

    // Output polilinea nel canale corretto
    if (isAcceptable)
    {
      a = poly;  // Faccia buona
      b = null;
    }
    else
    {
      a = null;
      b = poly;  // Faccia non valida
    }
  }

  // Funzione: somma degli angoli dal centro
  private double GetCentralAngleSum(Point3d center, Polyline poly)
  {
    if (poly == null || poly.Count < 3)
      return -1;

    int n = poly.Count - 1; // chiusa
    double sum = 0;

    for (int i = 0; i < n; i++)
    {
      Point3d ptA = poly[i];
      Point3d ptB = poly[(i + 1) % n];

      Vector3d va = ptA - center;
      Vector3d vb = ptB - center;

      if (va.IsZero || vb.IsZero)
        continue;

      va.Unitize();
      vb.Unitize();

      double angle = Vector3d.VectorAngle(va, vb);
      sum += angle;
    }

    return sum;
  }
}
# ---------- end c_script_16 ----------

# ---- group: NOT OK!
crv_8 = Curve(c_script_16.b)

# ----
panel_2 = Panel(c_script_16.c)
fromp = FromPolylines(Curves=crv_8, Min_Triangulation=True)
graft_4 = GraftTree(Tree=crv_8, IncludeEmptyLists=True, IncludeNullItems=True)
cpoly = ControlPolygon(Curve=graft_4)  # -> Polygon, Points
explodemesh = ExplodeMesh(Mesh=fromp, Explode=False)
weld = WeldMesh(Mesh=explodemesh, Radius=0.001, Align=False, Use_RTree=False)
tc = TangentCircles(Mesh=weld)  # -> Incircles, CirclePacking, Dual
triremesh_4 = TriRemesh(Geometry=weld, Length=Slider(0.5, range=0..1), Iterations=25)  # -> Triangulation, Dual, Creases

# ---- group: OK!
crv_9 = Curve(c_script_16.a)

# ----
fromp_2 = FromPolylines(Curves=crv_9, Min_Triangulation=True)
unim_2 = UnifyMesh(Mesh=fromp_2)  # -> Result, Count
explodemesh_2 = ExplodeMesh(Mesh=unim_2.Result, Explode=False)
weld_2 = WeldMesh(Mesh=explodemesh_2, Radius=0.001, Align=False, Use_RTree=False)

number_slider_21 = Slider(0, range=0..1)
number_slider_22 = Slider(0.388, range=0..1)
meshflap = MeshFlap(Mesh=weld_2, Dist=Slider(0.1, range=0..1), Flip=False, Normals=False, Chamfer=Toggle(False))  # -> Mesh, Curves
crv_10 = Curve(meshflap.Curves)

top_3 = GetPolylines(Mesh=weld_2)

# ---- group: Attempts (continued)
c_script_17 = CSharpScript(mesh=weld_2, baseScale=Slider(0.77, range=0..1), flapHeight=Slider(0.116, range=0..0.2))  # -> out, Flaps; inputs mesh: Mesh, baseScale: Double, flapHeight: Double
# ---------- c_script_17: C# ----------
// Grasshopper Script Instance
#region Usings
using System;
using System.Linq;
using System.Collections;
using System.Collections.Generic;
using System.Drawing;

using Rhino;
using Rhino.Geometry;

using Grasshopper;
using Grasshopper.Kernel;
using Grasshopper.Kernel.Data;
using Grasshopper.Kernel.Types;
using System;
using System.Collections.Generic;
using Rhino;
using Rhino.Geometry;
#endregion

public class Script_Instance : GH_ScriptInstance
{
  private void RunScript(
	Mesh mesh,
	double baseScale,
	double flapHeight,
	ref object Flaps)
  {
    List<Polyline> flaps = new List<Polyline>();

    // Mappa: faceIndex -> normale corretta
    Dictionary<int, Vector3d> faceNormals = new Dictionary<int, Vector3d>();

    // Calcola normali corrette per ogni faccia usando Plane.FitPlaneToPoints
    for (int i = 0; i < mesh.Faces.Count; i++)
    {
      MeshFace mf = mesh.Faces[i];
      List<Point3d> faceVerts = new List<Point3d>();

      faceVerts.Add(mesh.Vertices[mf.A]);
      faceVerts.Add(mesh.Vertices[mf.B]);
      faceVerts.Add(mesh.Vertices[mf.C]);
      if (mf.IsQuad)
        faceVerts.Add(mesh.Vertices[mf.D]);

      Plane facePlane;
      Plane.FitPlaneToPoints(faceVerts, out facePlane);

      Vector3d normal = facePlane.Normal;
      normal.Unitize();

      // Assicura coerenza con Z globale
      double alignment = Vector3d.Multiply(normal, Vector3d.ZAxis);
      if (alignment < 0)
        normal.Reverse();

      faceNormals[i] = normal;
    }

    // Per ogni faccia, lavora sui suoi lati
    for (int i = 0; i < mesh.Faces.Count; i++)
    {
      MeshFace face = mesh.Faces[i];
      Vector3d normal = faceNormals[i];

      List<int> indices = new List<int> { face.A, face.B, face.C };
      if (face.IsQuad)
        indices.Add(face.D);

      int count = indices.Count;
      for (int j = 0; j < count; j++)
      {
        int i0 = indices[j];
        int i1 = indices[(j + 1) % count];

        Point3d pt0 = mesh.Vertices[i0];
        Point3d pt1 = mesh.Vertices[i1];
        Line edge = new Line(pt0, pt1);
        Vector3d edgeVec = edge.Direction;
        edgeVec.Unitize();

        // Trova le facce adiacenti a entrambi i vertici
        HashSet<int> adjacentFaces = new HashSet<int>(mesh.TopologyVertices.ConnectedFaces(mesh.TopologyVertices.TopologyVertexIndex(i0)));
        adjacentFaces.IntersectWith(mesh.TopologyVertices.ConnectedFaces(mesh.TopologyVertices.TopologyVertexIndex(i1)));

        // Somma normali delle facce adiacenti (max 4)
        Vector3d avgNormal = new Vector3d(0, 0, 0);
        int countN = 0;
        foreach (int fi in adjacentFaces)
        {
          if (faceNormals.ContainsKey(fi))
          {
            avgNormal += faceNormals[fi];
            countN++;
          }
        }

        if (countN < 1)
          continue;

        avgNormal /= countN;
        avgNormal.Unitize();

        // Calcola piano passante per il lato con direzione media
        Vector3d flapDir = Vector3d.CrossProduct(edgeVec, avgNormal);
        if (!flapDir.IsValid || flapDir.IsZero)
          continue;

        flapDir.Unitize();

        // Costruisci i 4 punti del trapezio (rettangolo)
        double baseLen = pt0.DistanceTo(pt1);
        double flapWidth = baseLen * baseScale;

        Point3d mid = edge.PointAt(0.5);

        Plane flapPlane = new Plane(mid, edgeVec, flapDir);
        Transform toWorld = Transform.PlaneToPlane(Plane.WorldXY, flapPlane);

        Point3d p0 = new Point3d(-flapWidth / 2, 0, 0);
        Point3d p1 = new Point3d(flapWidth / 2, 0, 0);
        Point3d p2 = new Point3d(flapWidth / 2, 0, flapHeight);
        Point3d p3 = new Point3d(-flapWidth / 2, 0, flapHeight);

        p0.Transform(toWorld);
        p1.Transform(toWorld);
        p2.Transform(toWorld);
        p3.Transform(toWorld);

        flaps.Add(new Polyline(new List<Point3d> { p0, p1, p2, p3, p0 }));
      }
    }

    Flaps = flaps;
  }
}
# ---------- end c_script_17 ----------
c_script_18 = CSharpScript(faces=top_3, mesh=weld_2, length=number_slider_20, scale=number_slider_19, foldAngleDegrees=number_slider_18)  # -> out, tabs; inputs faces: list of Polyline, mesh: Mesh, length: Double, scale: Double, foldAngleDegrees: Double
# ---------- c_script_18: C# ----------
using System;
using System.Collections.Generic;
using Rhino;
using Rhino.Geometry;

public class Script_Instance : GH_ScriptInstance
{
  private void RunScript(
	List<Polyline> faces,
	Mesh mesh,
	double length,
	double scale,
	double foldAngleDegrees,
	ref object tabs)
  {
    List<Polyline> outputTabs = new List<Polyline>();
    Dictionary<string, List<Vector3d>> edgeNormals = new Dictionary<string, List<Vector3d>>();
    Dictionary<Polyline, Vector3d> faceDirections = new Dictionary<Polyline, Vector3d>();

    Func<Point3d, Point3d, string> edgeKey = (p1, p2) => {
      return p1.CompareTo(p2) < 0
        ? $"{p1.X:F4},{p1.Y:F4},{p1.Z:F4}-{p2.X:F4},{p2.Y:F4},{p2.Z:F4}"
        : $"{p2.X:F4},{p2.Y:F4},{p2.Z:F4}-{p1.X:F4},{p1.Y:F4},{p1.Z:F4}";
    };

    foreach (Polyline face in faces)
    {
      if (face == null || face.Count < 3) continue;

      Plane facePlane;
      Plane.FitPlaneToPoints(face, out facePlane);

      Vector3d faceNormal = facePlane.Normal;
      faceNormal.Unitize();

      // Confronta con la Z globale tramite prodotto scalare
      double alignment = Vector3d.Multiply(faceNormal, Vector3d.ZAxis);
      if (alignment < 0) // soglia per evitare falsi positivi
      {
        faceNormal.Reverse();
      }

      faceDirections[face] = faceNormal;
    }

    double foldAngleRad = RhinoMath.ToRadians(foldAngleDegrees);

    foreach (Polyline face in faces)
    {
      if (face == null || face.Count < 3 || !faceDirections.ContainsKey(face)) continue;

      Vector3d faceNormal = faceDirections[face];

      for (int i = 0; i < face.Count - 1; i++)
      {
        Point3d pt1 = face[i];
        Point3d pt2 = face[i + 1];
        string key = edgeKey(pt1, pt2);

        Line edge = new Line(pt1, pt2);
        Vector3d edgeDir = edge.Direction;
        edgeDir.Unitize();

        Vector3d foldDir = Vector3d.CrossProduct(edgeDir, faceNormal);
        if (!foldDir.IsValid || foldDir.IsZero) continue;
        foldDir.Unitize();

        double edgeLength = edge.Length;
        double halfW = (edgeLength * scale) / 2.0;

        // Costruzione linguetta nel piano XY
        Point3d p0 = new Point3d(-halfW, 0, 0);
        Point3d p1 = new Point3d(halfW, 0, 0);
        Point3d p2 = new Point3d(halfW, 0, length);
        Point3d p3 = new Point3d(-halfW, 0, length);

        // Ruota linguetta attorno all'asse X (piegatura)
        Transform foldRot = Transform.Rotation(foldAngleRad, Vector3d.XAxis, Point3d.Origin);
        p2.Transform(foldRot);
        p3.Transform(foldRot);

        // Costruzione piano locale
        Point3d mid = edge.PointAt(0.5);
        Plane localPlane = new Plane(mid, edgeDir, foldDir);
        Transform orient = Transform.PlaneToPlane(Plane.WorldXY, localPlane);
        p0.Transform(orient);
        p1.Transform(orient);
        p2.Transform(orient);
        p3.Transform(orient);

        outputTabs.Add(new Polyline(new List<Point3d> { p0, p1, p2, p3, p0 }));
      }
    }

    tabs = outputTabs;
  }
}
# ---------- end c_script_18 ----------
c_script_19 = CSharpScript(faces=top_3, mesh=weld_2, length=number_slider_20, scale=number_slider_19, foldAngleDegrees=number_slider_18)  # -> out, tabs; inputs faces: list of Polyline, mesh: Mesh, length: Double, scale: Double, foldAngleDegrees: Double; same code as c_script_18
c_script_20 = CSharpScript(faces=top_3, mesh=weld_2, length=number_slider_20, scale=number_slider_19)  # -> out, tabs; inputs faces: list of Polyline, mesh: Mesh, length: Double, scale: Double
# ---------- c_script_20: C# ----------
using System;
using System.Collections.Generic;
using Rhino;
using Rhino.Geometry;

public class Script_Instance : GH_ScriptInstance
{
  private void RunScript(
	List<Polyline> faces,
	Mesh mesh,
	double length,
	double scale,
	ref object tabs)
  {
    List<Polyline> outputTabs = new List<Polyline>();
    Dictionary<string, List<Vector3d>> edgeNormals = new Dictionary<string, List<Vector3d>>();

    // Funzione per chiave bordo unica
    Func<Point3d, Point3d, string> edgeKey = (p1, p2) => {
      return p1.CompareTo(p2) < 0
        ? $"{p1.X:F4},{p1.Y:F4},{p1.Z:F4}-{p2.X:F4},{p2.Y:F4},{p2.Z:F4}"
        : $"{p2.X:F4},{p2.Y:F4},{p2.Z:F4}-{p1.X:F4},{p1.Y:F4},{p1.Z:F4}";
    };

    // 1. Raccogli normali
    foreach (Polyline face in faces)
    {
      if (face == null || face.Count < 3) continue;

      for (int i = 0; i < face.Count - 1; i++)
      {
        Point3d pt1 = face[i];
        Point3d pt2 = face[i + 1];
        string key = edgeKey(pt1, pt2);

        Point3d midpoint = new Line(pt1, pt2).PointAt(0.5);
        MeshPoint mp = mesh.ClosestMeshPoint(midpoint, 0.01);
        if (mp == null) continue;

        Vector3d normal = mesh.NormalAt(mp);
        if (!normal.IsValid) continue;

        if (!edgeNormals.ContainsKey(key))
          edgeNormals[key] = new List<Vector3d>();

        edgeNormals[key].Add(normal);
      }
    }

    // 2. Genera linguette
    foreach (Polyline face in faces)
    {
      if (face == null || face.Count < 3) continue;

      for (int i = 0; i < face.Count - 1; i++)
      {
        Point3d pt1 = face[i];
        Point3d pt2 = face[i + 1];
        string key = edgeKey(pt1, pt2);
        if (!edgeNormals.ContainsKey(key)) continue;

        List<Vector3d> normals = edgeNormals[key];
        if (normals.Count == 0) continue;

        // Bisettrice delle normali
        Vector3d bisector = Vector3d.Zero;
        foreach (Vector3d n in normals) bisector += n;
        bisector.Unitize();

        Line edge = new Line(pt1, pt2);
        Vector3d edgeDir = edge.Direction;
        edgeDir.Unitize();

        Vector3d foldDir = Vector3d.CrossProduct(edgeDir, bisector);
        if (!foldDir.IsValid || foldDir.IsZero) continue;
        foldDir.Unitize();

        Point3d mid = edge.PointAt(0.5);

        double edgeLength = edge.Length;
        double halfW = (edgeLength * scale) / 2.0;

        Point3d p0 = mid - edgeDir * halfW;
        Point3d p1 = mid + edgeDir * halfW;
        Point3d p2 = p1 + foldDir * length;
        Point3d p3 = p0 + foldDir * length;

        outputTabs.Add(new Polyline(new List<Point3d> { p0, p1, p2, p3, p0 }));
      }
    }

    tabs = outputTabs;
  }
}
# ---------- end c_script_20 ----------
# ----
c_script_21 = CSharpScript(
    ngonFaces=top_3,
    mesh=weld_2,
    baseScale=Slider(0.84, range=0..1),
    flapHeight=Slider(0.109, range=0..0.2),
    materialThickness=Slider(0.025, range=0..0.1),
    holeOffsetFromBaseEdge=Slider(0.049, range=0..0.1),
    holeOffsetFromSideEdge=Slider(0.05, range=0..0.1),
    holeDiameter=Slider(0.022, range=0..0.1))  # -> out, Flaps, Holes; inputs ngonFaces: list of Polyline, mesh: Mesh, baseScale: Double, flapHeight: Double, materialThickness: Double, holeOffsetFromBaseEdge: Double, holeOffsetFromSideEdge: Double, holeDiameter: Double
# ---------- c_script_21: C# ----------
// Grasshopper Script Instance
#region Usings
using System;
using System.Linq;
using System.Collections;
using System.Collections.Generic;
using System.Drawing;

using Rhino;
using Rhino.Geometry;

using Grasshopper;
using Grasshopper.Kernel;
using Grasshopper.Kernel.Data;
using Grasshopper.Kernel.Types;
using System;
using System.Collections.Generic;
using Rhino;
using Rhino.Geometry;
#endregion


public class Script_Instance : GH_ScriptInstance
{
  private void RunScript(
	List<Polyline> ngonFaces,
	Mesh mesh,
	double baseScale,
	double flapHeight,
	double materialThickness,
	double holeOffsetFromBaseEdge,
	double holeOffsetFromSideEdge,
	double holeDiameter,
	ref object Flaps,
	ref object Holes)
  {
    List<Polyline> flaps = new List<Polyline>();
    List<Circle> holes = new List<Circle>();
    Dictionary<Polyline, Vector3d> ngonNormals = new Dictionary<Polyline, Vector3d>();

    foreach (Polyline face in ngonFaces)
    {
      if (face == null || face.Count < 3) continue;

      Plane plane;
      Plane.FitPlaneToPoints(face, out plane);
      Vector3d normal = plane.Normal;
      normal.Unitize();

      if (Vector3d.Multiply(normal, Vector3d.ZAxis) < 0) normal.Reverse();

      ngonNormals[face] = normal;
    }

    foreach (Polyline face in ngonFaces)
    {
      if (face == null || face.Count < 3 || !ngonNormals.ContainsKey(face)) continue;

      Vector3d normal = ngonNormals[face];
      int count = face.Count - 1;

      for (int i = 0; i < count; i++)
      {
        Point3d pt0 = face[i];
        Point3d pt1 = face[i + 1];

        Line edge = new Line(pt0, pt1);
        Vector3d edgeDir = edge.Direction;
        edgeDir.Unitize();

        List<Vector3d> nearbyNormals = new List<Vector3d>();
        foreach (Polyline other in ngonFaces)
        {
          if (other == face || !ngonNormals.ContainsKey(other)) continue;
          if (IsCloseToPolyline(pt0, other) || IsCloseToPolyline(pt1, other))
            nearbyNormals.Add(ngonNormals[other]);
        }

        Vector3d avgNormal = nearbyNormals.Count > 0 ?
          Vector3d.Divide(nearbyNormals.Aggregate((a, b) => a + b), nearbyNormals.Count) : normal;
        avgNormal.Unitize();

        Vector3d flapDir = Vector3d.CrossProduct(edgeDir, avgNormal);
        if (!flapDir.IsValid || flapDir.IsZero) continue;
        flapDir.Unitize();

        double baseLen = pt0.DistanceTo(pt1);
        double flapWidth = baseLen * baseScale;
        Point3d mid = edge.PointAt(0.5);

        Plane flapPlane = new Plane(mid, edgeDir, flapDir);

        // === Crea il flap (rettangolo nel piano flapPlane)
        Point3d p0 = flapPlane.PointAt(-flapWidth / 2, 0, 0);
        Point3d p1 = flapPlane.PointAt(flapWidth / 2, 0, 0);
        Point3d p2 = flapPlane.PointAt(flapWidth / 2, 0, flapHeight);
        Point3d p3 = flapPlane.PointAt(-flapWidth / 2, 0, flapHeight);

        flaps.Add(new Polyline(new List<Point3d> { p0, p1, p2, p3, p0 }));

        // === Calcolo dei fori
        double holeRadius = holeDiameter / 2.0;
        double z = holeOffsetFromBaseEdge;
        double leftX = -flapWidth / 2 + holeOffsetFromSideEdge;
        double rightX = flapWidth / 2 - holeOffsetFromSideEdge;

        Point3d center1 = flapPlane.PointAt(leftX, 0, z);
        Point3d center2 = flapPlane.PointAt(rightX, 0, z);

        // Costruisci piani per i fori (stesso orientamento dell’aletta)
        Plane holePlane1 = new Plane(center1, flapPlane.XAxis, flapPlane.YAxis);
        Plane holePlane2 = new Plane(center2, flapPlane.XAxis, flapPlane.YAxis);

        // Crea cerchi nel piano, ma questi sono verticali
        Circle c1 = new Circle(holePlane1, holeRadius);
        Circle c2 = new Circle(holePlane2, holeRadius);

        // Ruota ciascun cerchio attorno all'asse X del piano di 90° per sdraiarlo
        Transform rot1 = Transform.Rotation(Math.PI / 2, holePlane1.XAxis, center1);
        Transform rot2 = Transform.Rotation(Math.PI / 2, holePlane2.XAxis, center2);

        c1.Transform(rot1);
        c2.Transform(rot2);

        holes.Add(c1);
        holes.Add(c2);
      }
    }

    Flaps = flaps;
    Holes = holes;
  }

  private bool IsCloseToPolyline(Point3d pt, Polyline poly)
  {
    foreach (var p in poly)
      if (pt.DistanceTo(p) < RhinoDoc.ActiveDoc.ModelAbsoluteTolerance)
        return true;
    return false;
  }
}
# ---------- end c_script_21 ----------

c_script_22 = CSharpScript(
    ngonFaces=top_3,
    mesh=weld_2,
    baseScale=number_slider_6,
    flapHeight=number_slider_7,
    materialThickness=number_slider_4,
    holeOffsetFromProjection=number_slider_9,
    holeOffsetFromSideEdge=number_slider_3,
    holeOffsetFromFlapBaseEdge=number_slider_8,
    holeDiameter=number_slider_5)  # -> out, Flaps, Holes, CurvedProfiles; inputs ngonFaces: list of Polyline, mesh: Mesh, baseScale: Double, flapHeight: Double, materialThickness: Double, holeOffsetFromProjection: Double, holeOffsetFromSideEdge: Double, holeOffsetFromFlapBaseEdge: Double, holeDiameter: Double
# ---------- c_script_22: C# ----------
// Grasshopper Script Instance
#region Usings
using System;
using System.Linq;
using System.Collections;
using System.Collections.Generic;
using System.Drawing;

using Rhino;
using Rhino.Geometry;

using Grasshopper;
using Grasshopper.Kernel;
using Grasshopper.Kernel.Data;
using Grasshopper.Kernel.Types;
#endregion

public class Script_Instance : GH_ScriptInstance
{
  private void RunScript(
	List<Polyline> ngonFaces,
	Mesh mesh,
	double baseScale,
	double flapHeight,
	double materialThickness,
	double holeOffsetFromProjection,
	double holeOffsetFromSideEdge,
	double holeOffsetFromFlapBaseEdge,
	double holeDiameter,
	ref object Flaps,
	ref object Holes,
	ref object CurvedProfiles)
  {
    List<Polyline> flaps = new List<Polyline>();
    List<Circle> holes = new List<Circle>();
    List<Polyline> curvedProfiles = new List<Polyline>();

    Dictionary<Polyline, Vector3d> ngonNormals = new Dictionary<Polyline, Vector3d>();

    foreach (Polyline face in ngonFaces)
    {
      if (face == null || face.Count < 3)
        continue;

      Plane plane;
      Plane.FitPlaneToPoints(face, out plane);

      Vector3d normal = plane.Normal;
      normal.Unitize();

      if (Vector3d.Multiply(normal, Vector3d.ZAxis) < 0)
        normal.Reverse();

      ngonNormals[face] = normal;
    }

    foreach (Polyline face in ngonFaces)
    {
      if (face == null || face.Count < 3 || !ngonNormals.ContainsKey(face))
        continue;

      Vector3d normal = ngonNormals[face];
      int count = face.Count - 1;

      for (int i = 0; i < count; i++)
      {
        Point3d pt0 = face[i];
        Point3d pt1 = face[i + 1];

        Line edge = new Line(pt0, pt1);
        Vector3d edgeDir = edge.Direction;
        edgeDir.Unitize();

        List<Vector3d> nearbyNormals = new List<Vector3d>();
        foreach (Polyline other in ngonFaces)
        {
          if (other == face || !ngonNormals.ContainsKey(other))
            continue;

          if (IsCloseToPolyline(pt0, other) || IsCloseToPolyline(pt1, other))
            nearbyNormals.Add(ngonNormals[other]);
        }

        Vector3d avgNormal = new Vector3d(0, 0, 0);
        foreach (var n in nearbyNormals)
          avgNormal += n;

        if (nearbyNormals.Count > 0)
          avgNormal /= nearbyNormals.Count;
        else
          avgNormal = normal;

        avgNormal.Unitize();

        Vector3d flapDir = Vector3d.CrossProduct(edgeDir, avgNormal);
        if (!flapDir.IsValid || flapDir.IsZero)
          continue;

        flapDir.Unitize();

        double baseLen = pt0.DistanceTo(pt1);
        double flapWidth = baseLen * baseScale;
        Point3d mid = edge.PointAt(0.5);

        Plane flapPlane = new Plane(mid, edgeDir, flapDir);
        Transform toWorld = Transform.PlaneToPlane(Plane.WorldXY, flapPlane);

        Point3d p0 = new Point3d(-flapWidth / 2, 0, 0);
        Point3d p1 = new Point3d(flapWidth / 2, 0, 0);
        Point3d p2 = new Point3d(flapWidth / 2, 0, flapHeight);
        Point3d p3 = new Point3d(-flapWidth / 2, 0, flapHeight);

        p0.Transform(toWorld);
        p1.Transform(toWorld);
        p2.Transform(toWorld);
        p3.Transform(toWorld);

        flaps.Add(new Polyline(new List<Point3d> { p0, p1, p2, p3, p0 }));

        // Fori sulle alette
        double holeRadius = holeDiameter / 2.0;

        Vector3d flapX = flapPlane.XAxis;
        Vector3d flapZ = flapPlane.ZAxis;

        Point3d h0 = flapPlane.Origin + flapX * (-flapWidth / 2 + holeOffsetFromSideEdge) + flapZ * holeOffsetFromFlapBaseEdge;
        Point3d h1 = flapPlane.Origin + flapX * (flapWidth / 2 - holeOffsetFromSideEdge) + flapZ * holeOffsetFromFlapBaseEdge;

        Plane holePlane1 = new Plane(h0, flapX, flapZ);
        Plane holePlane2 = new Plane(h1, flapX, flapZ);

        holes.Add(new Circle(holePlane1, holeRadius));
        holes.Add(new Circle(holePlane2, holeRadius));

        // Curved connector
        Vector3d X = edgeDir;
        Vector3d Y = avgNormal;
        Vector3d Z = Vector3d.CrossProduct(X, Y); Z.Unitize();

        Plane connPlane = new Plane(pt0, X, Y);
        Transform flip180 = Transform.Rotation(Math.PI, X, pt0);

        int segments = 10;
        double rX = baseLen / 2.0 - holeDiameter;
        double rY = flapHeight;
        List<Point3d> curvePts = new List<Point3d>();

        for (int j = 0; j <= segments; j++)
        {
          double t = j * (Math.PI / 2) / segments;
          double x = rX * Math.Cos(t);
          double y = rY * Math.Sin(t);
          Point3d pt = connPlane.Origin + connPlane.XAxis * x + connPlane.YAxis * y;
          pt.Transform(flip180);
          curvePts.Add(pt);
        }

        curvedProfiles.Add(new Polyline(curvePts));
      }
    }

    Flaps = flaps;
    Holes = holes;
    CurvedProfiles = curvedProfiles;
  }

  private bool IsCloseToPolyline(Point3d pt, Polyline poly)
  {
    foreach (var p in poly)
    {
      if (pt.DistanceTo(p) < RhinoDoc.ActiveDoc.ModelAbsoluteTolerance)
        return true;
    }
    return false;
  }
}
# ---------- end c_script_22 ----------
c_script_23 = CSharpScript(
    ngonFaces=top_3,
    mesh=weld_2,
    baseScale=number_slider_6,
    flapHeight=number_slider_7,
    materialThickness=number_slider_4,
    holeOffsetFromProjection=number_slider_9,
    holeOffsetFromSideEdge=number_slider_3,
    holeOffsetFromFlapBaseEdge=number_slider_8,
    holeDiameter=number_slider_5)  # -> out, Flaps, Holes, CurvedProfiles; inputs ngonFaces: list of Polyline, mesh: Mesh, baseScale: Double, flapHeight: Double, materialThickness: Double, holeOffsetFromProjection: Double, holeOffsetFromSideEdge: Double, holeOffsetFromFlapBaseEdge: Double, holeDiameter: Double
# ---------- c_script_23: C# ----------
// Grasshopper Script Instance
#region Usings
using System;
using System.Linq;
using System.Collections;
using System.Collections.Generic;
using System.Drawing;

using Rhino;
using Rhino.Geometry;

using Grasshopper;
using Grasshopper.Kernel;
using Grasshopper.Kernel.Data;
using Grasshopper.Kernel.Types;
#endregion

public class Script_Instance : GH_ScriptInstance
{
  private void RunScript(
	List<Polyline> ngonFaces,
	Mesh mesh,
	double baseScale,
	double flapHeight,
	double materialThickness,
	double holeOffsetFromProjection,
	double holeOffsetFromSideEdge,
	double holeOffsetFromFlapBaseEdge,
	double holeDiameter,
	ref object Flaps,
	ref object Holes,
	ref object CurvedProfiles)
  {
    List<Polyline> flaps = new List<Polyline>();
    List<Circle> holes = new List<Circle>();
    List<Polyline> curvedProfiles = new List<Polyline>();

    Dictionary<Polyline, Vector3d> ngonNormals = new Dictionary<Polyline, Vector3d>();

    foreach (Polyline face in ngonFaces)
    {
      if (face == null || face.Count < 3)
        continue;

      Plane plane;
      Plane.FitPlaneToPoints(face, out plane);

      Vector3d normal = plane.Normal;
      normal.Unitize();

      if (Vector3d.Multiply(normal, Vector3d.ZAxis) < 0)
        normal.Reverse();

      ngonNormals[face] = normal;
    }

    HashSet<string> processedEdges = new HashSet<string>();

    foreach (Polyline face in ngonFaces)
    {
      if (face == null || face.Count < 3 || !ngonNormals.ContainsKey(face))
        continue;

      Vector3d normal = ngonNormals[face];
      int count = face.Count - 1;

      for (int i = 0; i < count; i++)
      {
        Point3d pt0 = face[i];
        Point3d pt1 = face[i + 1];

        Line edge = new Line(pt0, pt1);
        Vector3d edgeDir = edge.Direction;
        edgeDir.Unitize();

        List<Vector3d> nearbyNormals = new List<Vector3d>();
        foreach (Polyline other in ngonFaces)
        {
          if (other == face || !ngonNormals.ContainsKey(other))
            continue;

          if (IsCloseToPolyline(pt0, other) || IsCloseToPolyline(pt1, other))
            nearbyNormals.Add(ngonNormals[other]);
        }

        Vector3d avgNormal = new Vector3d(0, 0, 0);
        foreach (var n in nearbyNormals)
          avgNormal += n;

        if (nearbyNormals.Count > 0)
          avgNormal /= nearbyNormals.Count;
        else
          avgNormal = normal;

        avgNormal.Unitize();

        Vector3d flapDir = Vector3d.CrossProduct(edgeDir, avgNormal);
        if (!flapDir.IsValid || flapDir.IsZero)
          continue;

        flapDir.Unitize();

        double baseLen = pt0.DistanceTo(pt1);
        double flapWidth = baseLen * baseScale;
        Point3d mid = edge.PointAt(0.5);

        Plane flapPlane = new Plane(mid, edgeDir, flapDir);
        Transform toWorld = Transform.PlaneToPlane(Plane.WorldXY, flapPlane);

        Point3d p0 = new Point3d(-flapWidth / 2, 0, 0);
        Point3d p1 = new Point3d(flapWidth / 2, 0, 0);
        Point3d p2 = new Point3d(flapWidth / 2, 0, flapHeight);
        Point3d p3 = new Point3d(-flapWidth / 2, 0, flapHeight);

        p0.Transform(toWorld);
        p1.Transform(toWorld);
        p2.Transform(toWorld);
        p3.Transform(toWorld);

        flaps.Add(new Polyline(new List<Point3d> { p0, p1, p2, p3, p0 }));

        // Fori sulle alette
        double holeRadius = holeDiameter / 2.0;
        Vector3d flapX = flapPlane.XAxis;
        Vector3d flapZ = flapPlane.ZAxis;

        Point3d h0 = flapPlane.Origin + flapX * (-flapWidth / 2 + holeOffsetFromSideEdge) + flapZ * holeOffsetFromFlapBaseEdge;
        Point3d h1 = flapPlane.Origin + flapX * (flapWidth / 2 - holeOffsetFromSideEdge) + flapZ * holeOffsetFromFlapBaseEdge;

        Plane holePlane1 = new Plane(h0, flapX, flapZ);
        Plane holePlane2 = new Plane(h1, flapX, flapZ);

        holes.Add(new Circle(holePlane1, holeRadius));
        holes.Add(new Circle(holePlane2, holeRadius));

        string key1 = pt0.ToString() + pt1.ToString();
        string key2 = pt1.ToString() + pt0.ToString();
        if (processedEdges.Contains(key1) || processedEdges.Contains(key2)) continue;
        processedEdges.Add(key1);
        processedEdges.Add(key2);

        // Due ellissi corrette per ogni lato
        for (int j = 0; j < 2; j++)
        {
          Vector3d X = edgeDir;
          Vector3d Y = -avgNormal;
          Vector3d Z = Vector3d.CrossProduct(X, Y); Z.Unitize();

          Point3d origin = (j == 0) ? pt0 : pt1;

          Plane connPlane = new Plane(origin, X, Y);

          // Rotazione solo della seconda curva
          Transform rotation = Transform.Identity;
          if (j == 1)
            rotation = Transform.Rotation(Math.PI, Y, origin);

          int segments = 10;
          double rX = baseLen / 2.0 - holeDiameter;
          double rY = flapHeight;
          List<Point3d> curvePts = new List<Point3d>();

          for (int k = 0; k <= segments; k++)
          {
            double t = k * (Math.PI / 2) / segments;
            double x = rX * Math.Cos(t);
            double y = rY * Math.Sin(t);
            Point3d pt = connPlane.Origin + connPlane.XAxis * x + connPlane.YAxis * y;
            pt.Transform(rotation);
            curvePts.Add(pt);
          }

          curvedProfiles.Add(new Polyline(curvePts));
        }
      }
    }

    Flaps = flaps;
    Holes = holes;
    CurvedProfiles = curvedProfiles;
  }

  private bool IsCloseToPolyline(Point3d pt, Polyline poly)
  {
    foreach (var p in poly)
    {
      if (pt.DistanceTo(p) < RhinoDoc.ActiveDoc.ModelAbsoluteTolerance)
        return true;
    }
    return false;
  }
}
# ---------- end c_script_23 ----------
c_script_24 = CSharpScript(
    ngonFaces=top_3,
    mesh=weld_2,
    baseScale=number_slider_14,
    flapHeight=number_slider_13,
    materialThickness=Slider(0.025, range=0..0.1),
    holeOffsetFromBaseEdge=number_slider_10,
    holeOffsetFromSideEdge=number_slider_11,
    holeDiameter=number_slider_12)  # -> out, Flaps, Holes, CurvedProfiles, CurvedConnectors; inputs ngonFaces: list of Polyline, mesh: Mesh, baseScale: Double, flapHeight: Double, materialThickness: Double, holeOffsetFromBaseEdge: Double, holeOffsetFromSideEdge: Double, holeDiameter: Double
# ---------- c_script_24: C# ----------
// Grasshopper Script Instance
#region Usings
using System;
using System.Linq;
using System.Collections;
using System.Collections.Generic;
using System.Drawing;

using Rhino;
using Rhino.Geometry;

using Grasshopper;
using Grasshopper.Kernel;
using Grasshopper.Kernel.Data;
using Grasshopper.Kernel.Types;
#endregion

public class Script_Instance : GH_ScriptInstance
{
  private void RunScript(
	List<Polyline> ngonFaces,
	Mesh mesh,
	double baseScale,
	double flapHeight,
	double materialThickness,
	double holeOffsetFromBaseEdge,
	double holeOffsetFromSideEdge,
	double holeDiameter,
	ref object Flaps,
	ref object Holes,
	ref object CurvedProfiles,
	ref object CurvedConnectors)
  {
    var flaps = new List<Polyline>();
    var holes = new List<Circle>();
    var curvedProfiles = new List<Polyline>();
    var curvedSurfaces = new List<Surface>();

    double holeRadius = holeDiameter / 2.0;

    foreach (var face in ngonFaces)
    {
      if (face.Count < 4) continue;

      for (int i = 0; i < face.Count - 1; i++)
      {
        Point3d pt0 = face[i];
        Point3d pt1 = face[i + 1];

        Vector3d edgeDir = pt1 - pt0;
        if (!edgeDir.IsValid || edgeDir.IsZero) continue;
        edgeDir.Unitize();

        Plane plane;
        Plane.FitPlaneToPoints(face, out plane);
        Vector3d faceNormal = plane.Normal;
        faceNormal.Unitize();

        Vector3d flapDir = Vector3d.CrossProduct(edgeDir, faceNormal);
        if (!flapDir.IsValid || flapDir.IsZero) continue;
        flapDir.Unitize();

        Point3d mid = (pt0 + pt1) / 2;
        Plane flapPlane = new Plane(mid, edgeDir, flapDir);

        // === Flap rettangolo
        double flapWidth = pt0.DistanceTo(pt1) * baseScale;
        Point3d p0 = flapPlane.PointAt(-flapWidth / 2, 0, 0);
        Point3d p1 = flapPlane.PointAt(flapWidth / 2, 0, 0);
        Point3d p2 = flapPlane.PointAt(flapWidth / 2, 0, flapHeight);
        Point3d p3 = flapPlane.PointAt(-flapWidth / 2, 0, flapHeight);
        flaps.Add(new Polyline(new List<Point3d> { p0, p1, p2, p3, p0 }));

        // === Fori
        double leftX = -flapWidth / 2 + holeOffsetFromSideEdge;
        double rightX = flapWidth / 2 - holeOffsetFromSideEdge;
        double z = holeOffsetFromBaseEdge;

        Point3d center1 = flapPlane.PointAt(leftX, 0, z);
        Point3d center2 = flapPlane.PointAt(rightX, 0, z);

        Plane holePlane1 = new Plane(center1, flapPlane.XAxis, flapPlane.YAxis);
        Plane holePlane2 = new Plane(center2, flapPlane.XAxis, flapPlane.YAxis);

        Circle c1 = new Circle(holePlane1, holeRadius);
        Circle c2 = new Circle(holePlane2, holeRadius);
        c1.Transform(Transform.Rotation(Math.PI / 2, holePlane1.XAxis, center1));
        c2.Transform(Transform.Rotation(Math.PI / 2, holePlane2.XAxis, center2));
        holes.Add(c1);
        holes.Add(c2);

        // === Linguette curve sui due lati
        for (int h = 0; h < 2; h++)
        {
          Point3d a = (h == 0) ? center1 : center2;
          Vector3d arcDir = flapPlane.YAxis;
          Vector3d arcNormal = flapPlane.ZAxis;
          Plane arcPlane = new Plane(a, arcDir, arcNormal);

          Point3d arcStart = arcPlane.PointAt(0, 0);
          Point3d arcMid = arcPlane.PointAt(0, flapHeight);
          Point3d arcEnd = arcPlane.PointAt(0, 2 * flapHeight);

          Arc arc = new Arc(arcStart, arcMid, arcEnd);
          Curve arcCurve = arc.ToNurbsCurve();
          if (arcCurve == null) continue;

          Polyline arcPoly;
          if (!arcCurve.TryGetPolyline(out arcPoly)) continue;

          curvedProfiles.Add(arcPoly);

          Surface surf = Surface.CreateExtrusion(arcCurve, flapPlane.XAxis * materialThickness);
          if (surf != null)
            curvedSurfaces.Add(surf);
        }
      }
    }

    Flaps = flaps;
    Holes = holes;
    CurvedProfiles = curvedProfiles;
    CurvedConnectors = curvedSurfaces;
  }
}
# ---------- end c_script_24 ----------
c_script_25 = CSharpScript(
    ngonFaces=top_3,
    mesh=weld_2,
    baseScale=number_slider_6,
    flapHeight=number_slider_7,
    materialThickness=number_slider_4,
    holeOffsetFromBaseEdge=number_slider_2,
    holeOffsetFromSideEdge=number_slider_3,
    holeDiameter=number_slider_5)  # -> out, Flaps, Holes, CurvedProfiles; inputs ngonFaces: list of Polyline, mesh: Mesh, baseScale: Double, flapHeight: Double, materialThickness: Double, holeOffsetFromBaseEdge: Double, holeOffsetFromSideEdge: Double, holeDiameter: Double
# ---------- c_script_25: C# ----------
// Grasshopper Script Instance
#region Usings
using System;
using System.Linq;
using System.Collections;
using System.Collections.Generic;
using System.Drawing;

using Rhino;
using Rhino.Geometry;

using Grasshopper;
using Grasshopper.Kernel;
using Grasshopper.Kernel.Data;
using Grasshopper.Kernel.Types;
#endregion

public class Script_Instance : GH_ScriptInstance
{
  private void RunScript(
	List<Polyline> ngonFaces,
	Mesh mesh,
	double baseScale,
	double flapHeight,
	double materialThickness,
	double holeOffsetFromBaseEdge,
	double holeOffsetFromSideEdge,
	double holeDiameter,
	ref object Flaps,
	ref object Holes,
	ref object CurvedProfiles)
  {
    List<Polyline> flaps = new List<Polyline>();
    List<Circle> holes = new List<Circle>();
    List<Polyline> curvedProfiles = new List<Polyline>();

    Dictionary<Polyline, Vector3d> ngonNormals = new Dictionary<Polyline, Vector3d>();

    foreach (Polyline face in ngonFaces)
    {
      if (face == null || face.Count < 3)
        continue;

      Plane plane;
      Plane.FitPlaneToPoints(face, out plane);

      Vector3d normal = plane.Normal;
      normal.Unitize();

      if (Vector3d.Multiply(normal, Vector3d.ZAxis) < 0)
        normal.Reverse();

      ngonNormals[face] = normal;
    }

    foreach (Polyline face in ngonFaces)
    {
      if (face == null || face.Count < 3 || !ngonNormals.ContainsKey(face))
        continue;

      Vector3d normal = ngonNormals[face];
      int count = face.Count - 1;

      for (int i = 0; i < count; i++)
      {
        Point3d pt0 = face[i];
        Point3d pt1 = face[i + 1];

        Line edge = new Line(pt0, pt1);
        Vector3d edgeDir = edge.Direction;
        edgeDir.Unitize();

        List<Vector3d> nearbyNormals = new List<Vector3d>();
        foreach (Polyline other in ngonFaces)
        {
          if (other == face || !ngonNormals.ContainsKey(other))
            continue;

          if (IsCloseToPolyline(pt0, other) || IsCloseToPolyline(pt1, other))
            nearbyNormals.Add(ngonNormals[other]);
        }

        Vector3d avgNormal = new Vector3d(0, 0, 0);
        foreach (var n in nearbyNormals)
          avgNormal += n;

        if (nearbyNormals.Count > 0)
          avgNormal /= nearbyNormals.Count;
        else
          avgNormal = normal;

        avgNormal.Unitize();

        Vector3d flapDir = Vector3d.CrossProduct(edgeDir, avgNormal);
        if (!flapDir.IsValid || flapDir.IsZero)
          continue;

        flapDir.Unitize();

        double baseLen = pt0.DistanceTo(pt1);
        double flapWidth = baseLen * baseScale;
        Point3d mid = edge.PointAt(0.5);

        Plane flapPlane = new Plane(mid, edgeDir, flapDir);
        Transform toWorld = Transform.PlaneToPlane(Plane.WorldXY, flapPlane);

        Point3d p0 = new Point3d(-flapWidth / 2, 0, 0);
        Point3d p1 = new Point3d(flapWidth / 2, 0, 0);
        Point3d p2 = new Point3d(flapWidth / 2, 0, flapHeight);
        Point3d p3 = new Point3d(-flapWidth / 2, 0, flapHeight);

        p0.Transform(toWorld);
        p1.Transform(toWorld);
        p2.Transform(toWorld);
        p3.Transform(toWorld);

        flaps.Add(new Polyline(new List<Point3d> { p0, p1, p2, p3, p0 }));

        // Fori sulle alette
        double holeRadius = holeDiameter / 2.0;
        Point3d h0 = edge.PointAt(holeOffsetFromSideEdge / baseLen);
        Point3d h1 = edge.PointAt(1.0 - (holeOffsetFromSideEdge / baseLen));
        Vector3d moveUp = flapDir * holeOffsetFromBaseEdge;

        h0 += moveUp;
        h1 += moveUp;

        holes.Add(new Circle(new Plane(h0, flapDir), holeRadius));
        holes.Add(new Circle(new Plane(h1, flapDir), holeRadius));

        // Profilo curvo con porzione di ellisse
        Plane connPlane = new Plane();
        connPlane.Origin = pt0;
        connPlane.XAxis = edgeDir;
        connPlane.YAxis = ComputeAverageNgonNormal(pt0, ngonFaces);
        connPlane.ZAxis = Vector3d.CrossProduct(edgeDir, connPlane.YAxis);
        connPlane.ZAxis.Unitize();

        int segments = 10;
        double rX = flapHeight;
        double rZ = (baseLen * baseScale / 2.0) - holeDiameter;
        List<Point3d> curvePts = new List<Point3d>();

        Transform upRotation = Transform.Rotation(Math.PI / 2, connPlane.XAxis, connPlane.Origin);

        for (int j = 0; j <= segments; j++)
        {
          double t = j * (Math.PI / 2) / segments;
          double x = rX * Math.Cos(t);
          double z = rZ * Math.Sin(t);
          Point3d pt = connPlane.Origin + connPlane.XAxis * x + connPlane.ZAxis * z;
          pt.Transform(upRotation);
          curvePts.Add(pt);
        }

        curvedProfiles.Add(new Polyline(curvePts));
      }
    }

    Flaps = flaps;
    Holes = holes;
    CurvedProfiles = curvedProfiles;
  }

  private bool IsCloseToPolyline(Point3d pt, Polyline poly)
  {
    foreach (var p in poly)
    {
      if (pt.DistanceTo(p) < RhinoDoc.ActiveDoc.ModelAbsoluteTolerance)
        return true;
    }
    return false;
  }

  private Vector3d ComputeAverageNgonNormal(Point3d vertex, List<Polyline> faces)
  {
    Vector3d sum = Vector3d.Zero;
    int count = 0;

    foreach (var face in faces)
    {
      if (!face.Contains(vertex)) continue;
      Plane plane;
      Plane.FitPlaneToPoints(face, out plane);
      Vector3d normal = plane.Normal;
      if (Vector3d.Multiply(normal, Vector3d.ZAxis) < 0)
        normal.Reverse();
      sum += normal;
      count++;
    }

    if (count == 0) return Vector3d.ZAxis;
    sum.Unitize();
    return sum;
  }
}
# ---------- end c_script_25 ----------
c_script_26 = CSharpScript(
    ngonFaces=top_3,
    baseScale=number_slider_14,
    flapHeight=number_slider_13,
    holeOffsetFromBaseEdge=number_slider_10,
    holeOffsetFromSideEdge=number_slider_11,
    holeDiameter=number_slider_12)  # -> out, Flaps, Holes, CurvedProfiles; inputs ngonFaces: list of Polyline, baseScale: Double, flapHeight: Double, holeOffsetFromBaseEdge: Double, holeOffsetFromSideEdge: Double, holeDiameter: Double
# ---------- c_script_26: C# ----------
// Grasshopper Script Instance
#region Usings
using System;
using System.Linq;
using System.Collections;
using System.Collections.Generic;
using System.Drawing;

using Rhino;
using Rhino.Geometry;

using Grasshopper;
using Grasshopper.Kernel;
using Grasshopper.Kernel.Data;
using Grasshopper.Kernel.Types;
#endregion

public class Script_Instance : GH_ScriptInstance
{
  private void RunScript(
	List<Polyline> ngonFaces,
	double baseScale,
	double flapHeight,
	double holeOffsetFromBaseEdge,
	double holeOffsetFromSideEdge,
	double holeDiameter,
	ref object Flaps,
	ref object Holes,
	ref object CurvedProfiles)
  {
    var flaps = new List<Polyline>();
    var holes = new List<Circle>();
    var curvedProfiles = new List<Polyline>();
    double holeRadius = holeDiameter / 2.0;

    Dictionary<Polyline, Vector3d> ngonNormals = new Dictionary<Polyline, Vector3d>();

    foreach (Polyline face in ngonFaces)
    {
      if (face == null || face.Count < 3) continue;
      Plane plane;
      Plane.FitPlaneToPoints(face, out plane);
      Vector3d normal = plane.Normal;
      normal.Unitize();
      if (Vector3d.Multiply(normal, Vector3d.ZAxis) < 0)
        normal.Reverse();
      ngonNormals[face] = normal;
    }

    foreach (Polyline face in ngonFaces)
    {
      if (face == null || face.Count < 3 || !ngonNormals.ContainsKey(face)) continue;
      Vector3d normal = ngonNormals[face];
      int count = face.Count - 1;

      for (int i = 0; i < count; i++)
      {
        Point3d pt0 = face[i];
        Point3d pt1 = face[i + 1];
        Line edge = new Line(pt0, pt1);
        Vector3d edgeDir = edge.Direction;
        edgeDir.Unitize();

        Vector3d flapDir = Vector3d.CrossProduct(edgeDir, normal);
        flapDir.Unitize();

        double flapWidth = pt0.DistanceTo(pt1) * baseScale;
        Point3d mid = edge.PointAt(0.5);
        Plane flapPlane = new Plane(mid, edgeDir, flapDir);
        Transform toWorld = Transform.PlaneToPlane(Plane.WorldXY, flapPlane);

        Point3d p0 = new Point3d(-flapWidth / 2, 0, 0);
        Point3d p1 = new Point3d(flapWidth / 2, 0, 0);
        Point3d p2 = new Point3d(flapWidth / 2, 0, flapHeight);
        Point3d p3 = new Point3d(-flapWidth / 2, 0, flapHeight);
        p0.Transform(toWorld);
        p1.Transform(toWorld);
        p2.Transform(toWorld);
        p3.Transform(toWorld);
        flaps.Add(new Polyline(new List<Point3d> { p0, p1, p2, p3, p0 }));

        Point3d holeCenter1 = new Point3d(-flapWidth / 2 + holeOffsetFromSideEdge, 0, holeOffsetFromBaseEdge);
        Point3d holeCenter2 = new Point3d(flapWidth / 2 - holeOffsetFromSideEdge, 0, holeOffsetFromBaseEdge);
        holeCenter1.Transform(toWorld);
        holeCenter2.Transform(toWorld);
        Plane holePlane1 = new Plane(holeCenter1, flapDir);
        Plane holePlane2 = new Plane(holeCenter2, flapDir);
        holes.Add(new Circle(holePlane1, holeRadius));
        holes.Add(new Circle(holePlane2, holeRadius));

        double rX = flapHeight;
        double rY = (flapWidth / 2.0) - holeDiameter;
        if (rY <= 0) continue;

        Plane connPlane0 = new Plane(pt0, edgeDir, flapDir);
        Plane connPlane1 = new Plane(pt1, -edgeDir, flapDir);

        Polyline arc0 = BuildQuarterEllipseRotatedByXAxis(connPlane0, rX, rY);
        Polyline arc1 = BuildQuarterEllipseRotatedByXAxis(connPlane1, rX, rY);
        if (arc0 != null) curvedProfiles.Add(arc0);
        if (arc1 != null) curvedProfiles.Add(arc1);
      }
    }

    Flaps = flaps;
    Holes = holes;
    CurvedProfiles = curvedProfiles;
  }

  private Polyline BuildQuarterEllipseRotatedByXAxis(Plane plane, double rX, double rY)
  {
    int segments = 10;
    List<Point3d> pts = new List<Point3d>();

    for (int i = 0; i <= segments; i++)
    {
      double t = i * (Math.PI / 2) / segments;
      double x = rX * Math.Cos(t);
      double y = rY * Math.Sin(t);
      Point3d pt = plane.PointAt(x, y);
      pts.Add(pt);
    }

    Transform rotation = Transform.Rotation(Math.PI / 2, plane.XAxis, plane.Origin);
    for (int i = 0; i < pts.Count; i++)
    {
      pts[i].Transform(rotation);
    }

    return new Polyline(pts);
  }
}
# ---------- end c_script_26 ----------
c_script_27 = CSharpScript(
    ngonFaces=top_3,
    baseScale=number_slider_14,
    flapHeight=number_slider_13,
    holeOffsetFromBaseEdge=number_slider_10,
    holeOffsetFromSideEdge=number_slider_11,
    holeDiameter=number_slider_12)  # -> out, Flaps, Holes, CurvedProfiles; inputs ngonFaces: list of Polyline, baseScale: Double, flapHeight: Double, holeOffsetFromBaseEdge: Double, holeOffsetFromSideEdge: Double, holeDiameter: Double
# ---------- c_script_27: C# ----------
// Grasshopper Script Instance
#region Usings
using System;
using System.Linq;
using System.Collections;
using System.Collections.Generic;
using System.Drawing;

using Rhino;
using Rhino.Geometry;

using Grasshopper;
using Grasshopper.Kernel;
using Grasshopper.Kernel.Data;
using Grasshopper.Kernel.Types;
#endregion

public class Script_Instance : GH_ScriptInstance
{
  private void RunScript(
	List<Polyline> ngonFaces,
	double baseScale,
	double flapHeight,
	double holeOffsetFromBaseEdge,
	double holeOffsetFromSideEdge,
	double holeDiameter,
	ref object Flaps,
	ref object Holes,
	ref object CurvedProfiles)
  {
    var flaps = new List<Polyline>();
    var holes = new List<Circle>();
    var curvedProfiles = new List<Polyline>();
    double holeRadius = holeDiameter / 2.0;

    Dictionary<Polyline, Vector3d> ngonNormals = new Dictionary<Polyline, Vector3d>();

    // === Normali corrette ===
    foreach (Polyline face in ngonFaces)
    {
      if (face == null || face.Count < 3) continue;
      Plane plane;
      Plane.FitPlaneToPoints(face, out plane);
      Vector3d normal = plane.Normal;
      normal.Unitize();
      if (Vector3d.Multiply(normal, Vector3d.ZAxis) < 0)
        normal.Reverse();
      ngonNormals[face] = normal;
    }

    foreach (Polyline face in ngonFaces)
    {
      if (face == null || face.Count < 3 || !ngonNormals.ContainsKey(face)) continue;
      Vector3d normal = ngonNormals[face];
      int count = face.Count - 1;

      for (int i = 0; i < count; i++)
      {
        Point3d pt0 = face[i];
        Point3d pt1 = face[i + 1];

        Line edge = new Line(pt0, pt1);
        Vector3d edgeDir = edge.Direction;
        edgeDir.Unitize();

        Vector3d flapDir = Vector3d.CrossProduct(edgeDir, normal);
        if (!flapDir.IsValid || flapDir.IsZero) continue;
        flapDir.Unitize();

        double flapWidth = pt0.DistanceTo(pt1) * baseScale;
        Point3d mid = edge.PointAt(0.5);
        Plane flapPlane = new Plane(mid, edgeDir, flapDir);
        Transform toWorld = Transform.PlaneToPlane(Plane.WorldXY, flapPlane);

        // === Flap rettangolo ===
        Point3d p0 = new Point3d(-flapWidth / 2, 0, 0);
        Point3d p1 = new Point3d(flapWidth / 2, 0, 0);
        Point3d p2 = new Point3d(flapWidth / 2, 0, flapHeight);
        Point3d p3 = new Point3d(-flapWidth / 2, 0, flapHeight);
        p0.Transform(toWorld);
        p1.Transform(toWorld);
        p2.Transform(toWorld);
        p3.Transform(toWorld);
        flaps.Add(new Polyline(new List<Point3d> { p0, p1, p2, p3, p0 }));

        // === Fori ===
        Point3d holeCenter1 = new Point3d(-flapWidth / 2 + holeOffsetFromSideEdge, 0, holeOffsetFromBaseEdge);
        Point3d holeCenter2 = new Point3d(flapWidth / 2 - holeOffsetFromSideEdge, 0, holeOffsetFromBaseEdge);
        holeCenter1.Transform(toWorld);
        holeCenter2.Transform(toWorld);
        Plane holePlane1 = new Plane(holeCenter1, flapDir);
        Plane holePlane2 = new Plane(holeCenter2, flapDir);
        holes.Add(new Circle(holePlane1, holeRadius));
        holes.Add(new Circle(holePlane2, holeRadius));

        // === Curve 1/4 ellisse (con rotazione corretta) ===
        double rX = flapHeight;
        double rY = (flapWidth / 2) - holeDiameter;
        if (rY <= 0) continue;

        // Curve agli estremi della flap
        Plane connPlane0 = new Plane(pt0, flapDir, edgeDir);
        Plane connPlane1 = new Plane(pt1, flapDir, -edgeDir);

        Polyline arc0 = BuildQuarterEllipse(connPlane0, rX, rY);
        Polyline arc1 = BuildQuarterEllipse(connPlane1, rX, rY);
        if (arc0 != null) curvedProfiles.Add(arc0);
        if (arc1 != null) curvedProfiles.Add(arc1);
      }
    }

    Flaps = flaps;
    Holes = holes;
    CurvedProfiles = curvedProfiles;
  }

  // === Curva ellittica 1/4, ruotata correttamente ===
  private Polyline BuildQuarterEllipse(Plane plane, double rX, double rY)
  {
    int segments = 10;
    List<Point3d> pts = new List<Point3d>();
    for (int i = 0; i <= segments; i++)
    {
      double t = i * (Math.PI / 2) / segments; // 0 → π/2
      double x = rX * Math.Sin(t); // verticale
      double y = rY * Math.Cos(t); // orizzontale
      Point3d pt = plane.Origin + (plane.XAxis * y) + (plane.YAxis * x); // ROTAZIONE qui
      pts.Add(pt);
    }
    return new Polyline(pts);
  }
}
# ---------- end c_script_27 ----------
c_script_28 = CSharpScript(
    ngonFaces=top_3,
    mesh=weld_2,
    baseScale=number_slider_6,
    flapHeight=number_slider_7,
    materialThickness=number_slider_4,
    holeOffsetFromBaseEdge=number_slider_2,
    holeOffsetFromSideEdge=number_slider_3,
    holeDiameter=number_slider_5)  # -> out, Flaps, Holes, CurvedProfiles; inputs ngonFaces: list of Polyline, mesh: Mesh, baseScale: Double, flapHeight: Double, materialThickness: Double, holeOffsetFromBaseEdge: Double, holeOffsetFromSideEdge: Double, holeDiameter: Double
# ---------- c_script_28: C# ----------
// Grasshopper Script Instance
#region Usings
using System;
using System.Linq;
using System.Collections;
using System.Collections.Generic;
using System.Drawing;

using Rhino;
using Rhino.Geometry;

using Grasshopper;
using Grasshopper.Kernel;
using Grasshopper.Kernel.Data;
using Grasshopper.Kernel.Types;
#endregion

public class Script_Instance : GH_ScriptInstance
{
  private void RunScript(
	List<Polyline> ngonFaces,
	Mesh mesh,
	double baseScale,
	double flapHeight,
	double materialThickness,
	double holeOffsetFromBaseEdge,
	double holeOffsetFromSideEdge,
	double holeDiameter,
	ref object Flaps,
	ref object Holes,
	ref object CurvedProfiles)
  {
    List<Polyline> flaps = new List<Polyline>();
    List<Circle> holes = new List<Circle>();
    List<Polyline> curvedProfiles = new List<Polyline>();

    Dictionary<Polyline, Vector3d> ngonNormals = new Dictionary<Polyline, Vector3d>();

    foreach (Polyline face in ngonFaces)
    {
      if (face == null || face.Count < 3)
        continue;

      Plane plane;
      Plane.FitPlaneToPoints(face, out plane);

      Vector3d normal = plane.Normal;
      normal.Unitize();

      if (Vector3d.Multiply(normal, Vector3d.ZAxis) < 0)
        normal.Reverse();

      ngonNormals[face] = normal;
    }

    foreach (Polyline face in ngonFaces)
    {
      if (face == null || face.Count < 3 || !ngonNormals.ContainsKey(face))
        continue;

      Vector3d normal = ngonNormals[face];
      int count = face.Count - 1;

      for (int i = 0; i < count; i++)
      {
        Point3d pt0 = face[i];
        Point3d pt1 = face[i + 1];

        Line edge = new Line(pt0, pt1);
        Vector3d edgeDir = edge.Direction;
        edgeDir.Unitize();

        List<Vector3d> nearbyNormals = new List<Vector3d>();
        foreach (Polyline other in ngonFaces)
        {
          if (other == face || !ngonNormals.ContainsKey(other))
            continue;

          if (IsCloseToPolyline(pt0, other) || IsCloseToPolyline(pt1, other))
            nearbyNormals.Add(ngonNormals[other]);
        }

        Vector3d avgNormal = new Vector3d(0, 0, 0);
        foreach (var n in nearbyNormals)
          avgNormal += n;

        if (nearbyNormals.Count > 0)
          avgNormal /= nearbyNormals.Count;
        else
          avgNormal = normal;

        avgNormal.Unitize();

        Vector3d flapDir = Vector3d.CrossProduct(edgeDir, avgNormal);
        if (!flapDir.IsValid || flapDir.IsZero)
          continue;

        flapDir.Unitize();

        double baseLen = pt0.DistanceTo(pt1);
        double flapWidth = baseLen * baseScale;
        Point3d mid = edge.PointAt(0.5);

        Plane flapPlane = new Plane(mid, edgeDir, flapDir);
        Transform toWorld = Transform.PlaneToPlane(Plane.WorldXY, flapPlane);

        Point3d p0 = new Point3d(-flapWidth / 2, 0, 0);
        Point3d p1 = new Point3d(flapWidth / 2, 0, 0);
        Point3d p2 = new Point3d(flapWidth / 2, 0, flapHeight);
        Point3d p3 = new Point3d(-flapWidth / 2, 0, flapHeight);

        p0.Transform(toWorld);
        p1.Transform(toWorld);
        p2.Transform(toWorld);
        p3.Transform(toWorld);

        flaps.Add(new Polyline(new List<Point3d> { p0, p1, p2, p3, p0 }));

        // Fori sulle alette (usando assi del flapPlane)
        double holeRadius = holeDiameter / 2.0;
        Point3d h0 = edge.PointAt(holeOffsetFromSideEdge / baseLen);
        Point3d h1 = edge.PointAt(1.0 - (holeOffsetFromSideEdge / baseLen));
        Vector3d moveUp = flapDir * holeOffsetFromBaseEdge;
        h0 += moveUp;
        h1 += moveUp;

        Plane holePlane1 = new Plane(h0, flapPlane.XAxis, flapPlane.ZAxis);
        Plane holePlane2 = new Plane(h1, flapPlane.XAxis, flapPlane.ZAxis);

        holes.Add(new Circle(holePlane1, holeRadius));
        holes.Add(new Circle(holePlane2, holeRadius));

        // Curved connector
        Vector3d X = edgeDir;
        Vector3d Y = avgNormal;

        Vector3d Z = Vector3d.CrossProduct(X, Y); Z.Unitize();

        Plane connPlane = new Plane(pt0, X, Y);

        // ruota la curva attorno a X di 180° per invertire verso
        Transform flip180 = Transform.Rotation(-Math.PI, X, pt0);

        int segments = 10;
        double rX = baseLen / 2.0 - holeDiameter;
        double rY = flapHeight;
        List<Point3d> curvePts = new List<Point3d>();

        for (int j = 0; j <= segments; j++)
        {
          double t = j * (Math.PI / 2) / segments;
          double x = rX * Math.Cos(t);
          double y = rY * Math.Sin(t);
          Point3d pt = connPlane.Origin + connPlane.XAxis * x + connPlane.YAxis * y;
          pt.Transform(flip180);
          curvePts.Add(pt);
        }

        curvedProfiles.Add(new Polyline(curvePts));
      }
    }

    Flaps = flaps;
    Holes = holes;
    CurvedProfiles = curvedProfiles;
  }

  private bool IsCloseToPolyline(Point3d pt, Polyline poly)
  {
    foreach (var p in poly)
    {
      if (pt.DistanceTo(p) < RhinoDoc.ActiveDoc.ModelAbsoluteTolerance)
        return true;
    }
    return false;
  }
}
# ---------- end c_script_28 ----------
c_script_29 = CSharpScript(ngonFaces=top_3, baseScale=number_slider_14, flapHeight=number_slider_13)  # -> out, PlaneViz, TestCurve; inputs ngonFaces: list of Polyline, baseScale: Double, flapHeight: Double
# ---------- c_script_29: C# ----------
// Grasshopper Script Instance
#region Usings
using System;
using System.Linq;
using System.Collections;
using System.Collections.Generic;
using System.Drawing;

using Rhino;
using Rhino.Geometry;

using Grasshopper;
using Grasshopper.Kernel;
using Grasshopper.Kernel.Data;
using Grasshopper.Kernel.Types;
#endregion

public class Script_Instance : GH_ScriptInstance
{
  private void RunScript(
	List<Polyline> ngonFaces,
	double baseScale,
	double flapHeight,
	ref object PlaneViz,
	ref object TestCurve)
  {
    if (ngonFaces == null || ngonFaces.Count == 0) return;

    Polyline face = ngonFaces[0];
    if (face.Count < 4) return;

    Point3d pt0 = face[0];
    Point3d pt1 = face[1];

    Vector3d edgeDir = pt1 - pt0;
    edgeDir.Unitize();

    Vector3d avgNgonNormal = ComputeAverageNgonNormal(pt0, ngonFaces);
    Vector3d zAxis = Vector3d.CrossProduct(edgeDir, avgNgonNormal);
    zAxis.Unitize();

    Plane connPlane = new Plane();
    connPlane.Origin = pt0;
    connPlane.XAxis = edgeDir;
    connPlane.YAxis = avgNgonNormal;
    connPlane.ZAxis = zAxis;

    List<Line> axes = new List<Line>();
    double len = flapHeight * 1.2;
    axes.Add(new Line(connPlane.Origin, connPlane.Origin + connPlane.XAxis * len));
    axes.Add(new Line(connPlane.Origin, connPlane.Origin + connPlane.YAxis * len));
    axes.Add(new Line(connPlane.Origin, connPlane.Origin + connPlane.ZAxis * len));

    int segments = 10;
    double rX = flapHeight;
    double rZ = (pt0.DistanceTo(pt1) * baseScale / 2.0) * 0.8;
    List<Point3d> pts = new List<Point3d>();

    Transform downRotation = Transform.Rotation(Math.PI / 2, connPlane.XAxis, connPlane.Origin);

    for (int i = 0; i <= segments; i++)
    {
      double t = i * (Math.PI / 2) / segments;
      double x = rX * Math.Cos(t);
      double z = rZ * Math.Sin(t);
      Point3d pt = connPlane.Origin + connPlane.XAxis * x + connPlane.ZAxis * z;

      pt.Transform(downRotation); // ruota sul piano XY−

      pts.Add(pt);
    }

    PlaneViz = axes;
    TestCurve = new Polyline(pts);
  }

  private Vector3d ComputeAverageNgonNormal(Point3d vertex, List<Polyline> faces)
  {
    Vector3d sum = Vector3d.Zero;
    int count = 0;

    foreach (var face in faces)
    {
      if (!face.Contains(vertex)) continue;
      Plane plane;
      Plane.FitPlaneToPoints(face, out plane);
      Vector3d normal = plane.Normal;
      if (Vector3d.Multiply(normal, Vector3d.ZAxis) < 0)
        normal.Reverse();
      sum += normal;
      count++;
    }

    if (count == 0) return Vector3d.ZAxis;
    sum.Unitize();
    return sum;
  }
}
# ---------- end c_script_29 ----------
